# Grasshopper definition BBOX_COMPONENT.gh (Grasshopper 1.0.8)

epsg_in = GetInteger(
    "4326",
    AtLeast=1,
    AtMost=1,
    Maximum=2147483647,
    Minimum=-2147483648,
    Prompt="EPSG code for which your Lat and Lng coordinates are based in",
    TreeAccess=False)
latitude = GetNumber(
    "51.54239",
    AtLeast=1,
    AtMost=1,
    Maximum=1.797693135e+308,
    Minimum=-1.797693135e+308,
    Prompt="Latitude coordinate in the EPSG provided",
    TreeAccess=False)
longitude = GetNumber(
    "-0.05193",
    AtLeast=1,
    AtMost=1,
    Maximum=1.797693135e+308,
    Minimum=-1.797693135e+308,
    Prompt="Lon coordintae in the EPSG provided",
    TreeAccess=False)
radius = GetInteger("500", AtLeast=1, AtMost=1, Maximum=2147483647, Minimum=-2147483648, Prompt="Radius of analysis area", TreeAccess=False)
epsg_out = GetInteger(
    "27700",
    AtLeast=1,
    AtMost=1,
    Maximum=2147483647,
    Minimum=-2147483648,
    Prompt="EPSG to re-project your BBox into",
    TreeAccess=False)
bbox = Python3Script(EPSG_in=epsg_in, Latitude=latitude, Longitude=longitude, rad=radius, EPSG_out=epsg_out)  # -> out, Geo, BBox; inputs rad: Int32
# ---------- bbox: Python ----------
# r: pyproj
#! python 3

import Rhino.Geometry as rg
from pyproj import CRS, Transformer
import traceback
import math

try:
    # --------------------------------------------
    # Inputs from Grasshopper
    lat = float(Latitude)
    lon = float(Longitude)
    epsg_in = f"EPSG:{int(EPSG_in)}"
    epsg_out = f"EPSG:{int(EPSG_out)}"
    half_size = float(rad)

    # Check if output CRS is geographic (degrees) or projected (meters)
    crs_out = CRS.from_user_input(epsg_out)
    is_geographic = crs_out.is_geographic

    if is_geographic:
        # --------------------------------------------
        # Convert rad from meters to degrees
        lat_buffer = half_size / 111000.0
        lon_buffer = half_size / (111000.0 * math.cos(math.radians(lat)))

        x_lower = lon - lon_buffer
        x_upper = lon + lon_buffer
        y_lower = lat - lat_buffer
        y_upper = lat + lat_buffer

        # Polyline in degrees
        corners = [
            rg.Point3d(x_lower, y_lower, 0),
            rg.Point3d(x_upper, y_lower, 0),
            rg.Point3d(x_upper, y_upper, 0),
            rg.Point3d(x_lower, y_upper, 0),
            rg.Point3d(x_lower, y_lower, 0)
        ]

    else:
        # --------------------------------------------
        # Transform to projected CRS
        transformer = Transformer.from_crs(epsg_in, epsg_out, always_xy=True)
        x_cen, y_cen = transformer.transform(lon, lat)

        x_lower = x_cen - half_size
        x_upper = x_cen + half_size
        y_lower = y_cen - half_size
        y_upper = y_cen + half_size

        # Polyline in projected coords
        corners = [
            rg.Point3d(x_lower, y_lower, 0),
            rg.Point3d(x_upper, y_lower, 0),
            rg.Point3d(x_upper, y_upper, 0),
            rg.Point3d(x_lower, y_upper, 0),
            rg.Point3d(x_lower, y_lower, 0)
        ]

    # --------------------------------------------
    # Create Rhino curve
    polyline = rg.Polyline(corners).ToNurbsCurve()

    # Outputs
    Geo = polyline
    BBox = f"{x_lower},{y_lower},{x_upper},{y_upper}"

except Exception as e:
    Geo = None
    BBox = f"❌ Error: {str(e)}"
# ---------- end bbox ----------
merge = Merge(Data1=bbox.BBox, Data2=epsg_out)
linetype = ModelLinetype("Model Linetype : Border")
object_linetype = ObjectLinetype(Linetype=linetype)  # -> Linetype, Source, ModelLinetype
display = DisplayAttributes(DisplayColour=ColourSwatch(SwatchColor=RGB(255, 0, 0)))  # -> Display, DisplayColour, DisplayMode
drafting = DraftingAttributes(Linetype=object_linetype.Linetype)  # -> Drafting, Linetype, LinetypeScale
object = ModelObject(Geometry=bbox.Geo, Layer="UC::BBox", Display=display.Display, Drafting=drafting.Drafting)  # -> Object, Geometry, Name, Layer, Visibility, Display, Drafting, Render
panel = Panel("""BBox
EPSG""")
u_text = UserText(Content=object.Object, Keys=panel, Values=merge, UserTextMode=1)  # -> Content, Keys, Values
c_bake = ContextBake(Content=u_text.Content)
