# Grasshopper definition DEFRA_COMPONENT.gh (Grasshopper 1.0.8)

bbox_27700 = GetString("534690.0,183908.0,535690.0,184908.0", AtLeast=1, AtMost=1, Prompt="BBox in EPSG:27700", TreeAccess=False)
defra_habitat = Python3Script(BBox=bbox_27700)  # -> out, Geo, Attr
# ---------- defra_habitat: Python ----------
#! python 3
#r: requests, shapely

import json
import requests
from shapely.geometry import shape, Polygon, MultiPolygon
import Rhino.Geometry as rg
import Grasshopper
import Grasshopper.Kernel as gh

def fetch_habitat_features(bbox_vals):
    bbox_str = ",".join(map(str, bbox_vals))
    url = (
        "https://services.arcgis.com/JJzESW51TqeY9uat/arcgis/rest/services/"
        "Living_England_Habitat_Map_Phase4/FeatureServer/0/query?"
        f"where=1%3D1&outFields=*&geometry={bbox_str}"
        "&geometryType=esriGeometryEnvelope&inSR=27700"
        "&spatialRel=esriSpatialRelIntersects&outSR=27700&f=geojson"
    )
    print("🌿 Requesting habitat data...")
    res = requests.get(url)
    res.raise_for_status()
    return json.loads(res.text)

def to_rhino_geometry(geom):
    if isinstance(geom, Polygon):
        coords = list(geom.exterior.coords)
        points = [rg.Point3d(x, y, 0) for x, y in coords]
        return rg.Polyline(points).ToNurbsCurve()
    elif isinstance(geom, MultiPolygon):
        curves = []
        for poly in geom.geoms:
            coords = list(poly.exterior.coords)
            points = [rg.Point3d(x, y, 0) for x, y in coords]
            curves.append(rg.Polyline(points).ToNurbsCurve())
        return curves
    return None

def parse_geojson_features(geojson):
    rhino_geoms = []
    attr_list = []

    for feature in geojson.get("features", []):
        geom = shape(feature["geometry"])
        rh_geom = to_rhino_geometry(geom)
        props = feature.get("properties", {})

        if isinstance(rh_geom, list):
            for g in rh_geom:
                rhino_geoms.append(g)
                attr_list.append(props)
        elif rh_geom:
            rhino_geoms.append(rh_geom)
            attr_list.append(props)

    return rhino_geoms, attr_list

def attrs_to_tree(attributes):
    tree = Grasshopper.DataTree[str]()
    for i, attr in enumerate(attributes):
        path = gh.Data.GH_Path(i)
        for k, v in attr.items():
            tree.Add(f"{k}: {v}", path)
    return tree

# === MAIN ===
try:
    print("✅ Grasshopper script executing")
    bbox_vals = list(map(float, BBox.split(",")))
    print(f"📦 Parsed BBox: {bbox_vals}")

    geojson = fetch_habitat_features(bbox_vals)
    geoms, attrs = parse_geojson_features(geojson)

    Geo = geoms
    Attr = attrs_to_tree(attrs)

    print(f"🟢 Habitat features parsed: {len(geoms)}")

except Exception as e:
    import traceback
    print(f"❌ Error: {str(e)}")
    tree = Grasshopper.DataTree[str]()
    tree.Add(str(e), gh.Data.GH_Path(0))
    tree.Add(traceback.format_exc(), gh.Data.GH_Path(1))
    Geo = []
    Attr = tree
# ---------- end defra_habitat ----------
split = TextSplit(Text=defra_habitat.Attr, Separators=":")
c_print = ContextPrint(Text=defra_habitat.out)
item = ListItem(List=split, Index=0, Wrap=True)
item_2 = ListItem(List=split, Index=1, Wrap=True)
pshift = ShiftPaths(Data=item, Offset=-1)
pshift_2 = ShiftPaths(Data=item_2, Offset=-1)
object = ModelObject(Geometry=graft(defra_habitat.Geo), Layer="UC::DEFRA")  # -> Object, Geometry, Name, Layer, Visibility, Display, Drafting, Render
u_text = UserText(Content=object.Object, Keys=pshift, Values=pshift_2, UserTextMode=1)  # -> Content, Keys, Values
c_bake = ContextBake(Content=u_text.Content)
