# Grasshopper definition FLOODING_COMPONENT.gh (Grasshopper 1.0.8)

bbox = GetString(
    "534690.0,183908.0,535690.0,184908.0",
    AtLeast=1,
    AtMost=1,
    Prompt="BBox (if generated through the BBox component, this should be in the BBox layer attribute information)",
    TreeAccess=False)
flooding = Python3Script(BBox=bbox)  # -> out, Geo_RiskAreas, Attr_RiskArea, Geo_Zone2, Attr_Zone2, Geo_Zone3, Attr_Zone3; inputs BBox: String
# ---------- flooding: Python ----------
#! python 3
#r: requests, shapely, pyproj

import json
import requests
from shapely.geometry import shape
from shapely.ops import transform as shapely_transform
from pyproj import Transformer
from Rhino.Geometry import PolylineCurve, Point3d
import Grasshopper, Grasshopper.Kernel as gh

# ------------------------------
# Fetch WFS Features
def fetch_wfs_features(base_url, typename, bbox):
    bbox_str = ",".join(map(str, bbox))
    full_url = (
        f"{base_url}?service=WFS&version=2.0.0&request=GetFeature"
        f"&typeNames={typename}&outputFormat=application/json"
        f"&bbox={bbox_str},urn:ogc:def:crs:EPSG::27700"
    )
    print(f"🌐 WFS request: {typename}")
    try:
        resp = requests.get(full_url)
        resp.raise_for_status()
        data = resp.json()
        features = []
        for f in data.get("features", []):
            props = f.get("properties", {})
            geom = shape(f.get("geometry"))
            features.append({"properties": props, "geometry": geom})
        return features
    except Exception as e:
        print(f"❌ Failed to fetch {typename}: {e}")
        return []

# ------------------------------
# Rhino conversion
def features_to_rhino_geom(features):
    rhino_geoms = []
    for feat in features:
        geom = feat["geometry"]
        if geom.geom_type == "Polygon":
            coords = list(geom.exterior.coords)
            points = [Point3d(x, y, 0) for x, y in coords]
            rhino_geoms.append(PolylineCurve(points))
        elif geom.geom_type == "MultiPolygon":
            for poly in geom.geoms:
                coords = list(poly.exterior.coords)
                points = [Point3d(x, y, 0) for x, y in coords]
                rhino_geoms.append(PolylineCurve(points))
    return rhino_geoms

def features_to_tree(features):
    tree = Grasshopper.DataTree[object]()
    for i, feat in enumerate(features):
        path = gh.Data.GH_Path(i)
        props = feat.get("properties", {})
        if props:
            for k, v in props.items():
                tree.Add(f"{k}: {v}", path)
        else:
            tree.Add("No attributes", path)
    return tree

# ------------------------------
# MAIN EXECUTION
try:
    print("🚀 Running flood layers script")

    # BBox is expected as EPSG:27700
    bbox = list(map(float, BBox.split(",")))
    print(f"Using BBox (EPSG:27700): {bbox}")

    # --- FLOOD LAYERS ---
    FLOODING_FLOOD_RISK_AREAS = fetch_wfs_features(
        "https://environment.data.gov.uk/spatialdata/flood-risk-areas/wfs",
        "dataset-f3d63ec5-a21a-49fb-803a-0fa0fb7238b6:Flood_Risk_Areas",
        bbox
    )

    FLOODING_FLOOD_ZONE3 = fetch_wfs_features(
        "https://environment.data.gov.uk/spatialdata/flood-map-for-planning-rivers-and-sea-flood-zone-3/wfs",
        "dataset-87446770-d465-11e4-b97a-f0def148f590:Flood_Map_for_Planning_Rivers_and_Sea_Flood_Zone_3",
        bbox
    )

    FLOODING_FLOOD_ZONE2 = fetch_wfs_features(
        "https://environment.data.gov.uk/spatialdata/flood-map-for-planning-rivers-and-sea-flood-zone-2/wfs",
        "dataset-86ec354f-d465-11e4-b09e-f0def148f590:Flood_Map_for_Planning_Rivers_and_Sea_Flood_Zone_2",
        bbox
    )

    # --- Convert to Rhino Geometries & Attributes ---
    Geo_RiskAreas = features_to_rhino_geom(FLOODING_FLOOD_RISK_AREAS)
    Attr_RiskAreas = features_to_tree(FLOODING_FLOOD_RISK_AREAS)

    Geo_Zone3 = features_to_rhino_geom(FLOODING_FLOOD_ZONE3)
    Attr_Zone3 = features_to_tree(FLOODING_FLOOD_ZONE3)

    Geo_Zone2 = features_to_rhino_geom(FLOODING_FLOOD_ZONE2)
    Attr_Zone2 = features_to_tree(FLOODING_FLOOD_ZONE2)

except Exception as e:
    import traceback
    Geo_RiskAreas = []
    Geo_Zone3 = []
    Geo_Zone2 = []
    s = Grasshopper.DataTree[object]()
    Attr_Zone3 = Grasshopper.DataTree[object]()
    Attr_Zone2 = Grasshopper.DataTree[object]()
    Attr_RiskAreas.Add(str(e), gh.Data.GH_Path(0))
    Attr_RiskAreas.Add(traceback.format_exc(), gh.Data.GH_Path(1))
# ---------- end flooding ----------
c_print = ContextPrint(Text=flooding.out)
split = TextSplit(Text=flooding.Attr_Zone3, Separators=":")
split_2 = TextSplit(Text=flooding.Attr_RiskArea, Separators=":")
split_3 = TextSplit(Text=flooding.Attr_Zone2, Separators=":")
concat = Concatenate(FragmentA="UC::Flood::", FragmentB="Zone_3")
trim = TextTrim(Text=split, Start=True, End=True)
concat_2 = Concatenate(FragmentA="UC::Flood::", FragmentB="Risk_Areas")
concat_3 = Concatenate(FragmentA="UC::Flood::", FragmentB="Zone_2")
trim_2 = TextTrim(Text=split_2, Start=True, End=True)
trim_3 = TextTrim(Text=split_3, Start=True, End=True)
item = ListItem(List=trim, Index=0, Wrap=True)  # -> flatten(Item)
item_2 = ListItem(List=trim, Index=1, Wrap=True)  # -> flatten(Item)
object = ModelObject(Geometry=flooding.Geo_Zone3, Layer=concat)  # -> Object, Geometry, Name, Layer, Visibility, Display, Drafting, Render
item_3 = ListItem(List=trim_2, Index=0, Wrap=True)  # -> flatten(Item)
item_4 = ListItem(List=trim_2, Index=1, Wrap=True)  # -> flatten(Item)
object_2 = ModelObject(Geometry=flooding.Geo_RiskAreas, Layer=concat_2)  # -> Object, Geometry, Name, Layer, Visibility, Display, Drafting, Render
item_5 = ListItem(List=trim_3, Index=0, Wrap=True)  # -> flatten(Item)
item_6 = ListItem(List=trim_3, Index=1, Wrap=True)  # -> flatten(Item)
object_3 = ModelObject(Geometry=flooding.Geo_Zone2, Layer=concat_3)  # -> Object, Geometry, Name, Layer, Visibility, Display, Drafting, Render
u_text = UserText(Content=object.Object, Keys=item, Values=item_2, UserTextMode=1)  # -> Content, Keys, Values
u_text_2 = UserText(Content=object_2.Object, Keys=item_3, Values=item_4, UserTextMode=1)  # -> Content, Keys, Values
u_text_3 = UserText(Content=object_3.Object, Keys=item_5, Values=item_6, UserTextMode=1)  # -> Content, Keys, Values
c_bake = ContextBake(Content=u_text.Content)
c_bake_2 = ContextBake(Content=u_text_2.Content)
c_bake_3 = ContextBake(Content=u_text_3.Content)
