# Grasshopper definition HERITAGE-ENGLAND_COMPONENT.gh (Grasshopper 1.0.8)

bbox = GetString(
    "534690.0,183908.0,535690.0,184908.0",
    AtLeast=1,
    AtMost=1,
    Prompt="BBox (if generated through the BBox component, this should be in the BBox layer attribute information)",
    TreeAccess=False)
historic_england = Python3Script(BBox=bbox)  # -> out, Geo_listedbuildings, Attr_listedbuildings, Geo_scheduledmonuments, Attr_scheduledmonuments, Geo_parksandgardens, Attr_parksandgardens, Geo_battlefields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
# ---------- historic_england: Python ----------
#! python 3
# r: shapely, pyproj, requests

import Rhino.Geometry as rg
import Grasshopper
import requests
import json
from shapely.geometry import shape, Polygon, MultiPolygon
from pyproj import Transformer

def build_nhle_url(layer_id, bbox):
    base_url = "https://services-eu1.arcgis.com/ZOdPfBS3aqqDYPUQ/arcgis/rest/services/National_Heritage_List_for_England_NHLE_v02_VIEW/FeatureServer"
    geom = f"{bbox[0]}%2C%20{bbox[1]}%2C%20{bbox[2]}%2C%20{bbox[3]}"
    query = (
        f"{base_url}/{layer_id}/query?"
        f"where=1%3D1&outFields=*&geometry={geom}"
        f"&geometryType=esriGeometryEnvelope&inSR=27700"
        f"&spatialRel=esriSpatialRelIntersects&outSR=27700&f=geojson"
    )
    return query

def fetch_geojson_manual(url):
    resp = requests.get(url)
    resp.raise_for_status()
    data = resp.json()
    features = data.get("features", [])
    result = []
    for feat in features:
        geom = shape(feat.get("geometry"))
        props = feat.get("properties", {})
        result.append({"geometry": geom, "properties": props})
    return result

def to_rhino_geometry(geom):
    if isinstance(geom, Polygon):
        pts = [rg.Point3d(x, y, 0) for x, y in geom.exterior.coords]
        return rg.Polyline(pts).ToNurbsCurve()
    elif isinstance(geom, MultiPolygon):
        curves = []
        for poly in geom.geoms:
            pts = [rg.Point3d(x, y, 0) for x, y in poly.exterior.coords]
            curves.append(rg.Polyline(pts).ToNurbsCurve())
        return curves
    return None

def process_features(features):
    geometries = []
    attr_list = []
    for f in features:
        geom = f["geometry"]
        props = f["properties"]
        rh_geom = to_rhino_geometry(geom)
        if isinstance(rh_geom, list):
            for g in rh_geom:
                geometries.append(g)
                attr_list.append(props)
        elif rh_geom:
            geometries.append(rh_geom)
            attr_list.append(props)
    return geometries, attr_list

def attrs_to_tree(attributes):
    tree = Grasshopper.DataTree[str]()
    for i, attr in enumerate(attributes):
        path = Grasshopper.Kernel.Data.GH_Path(i)
        for k, v in attr.items():
            tree.Add(f"{k}: {v}", path)
    return tree

# === MAIN ===
try:
    bbox_vals = list(map(float, BBox.split(",")))

    layers = {
        "ListedBuildings": 3,
        "ScheduledMonuments": 6,
        "ParksAndGardens": 7,
        "Battlefields": 8,
        "WorldHeritageSites": 10
    }

    result = {}
    for key, lid in layers.items():
        url = build_nhle_url(lid, bbox_vals)
        features = fetch_geojson_manual(url)
        geoms, attrs = process_features(features)
        result[key] = (geoms, attrs_to_tree(attrs))

    Geo_listedbuildings, Attr_listedbuildings = result["ListedBuildings"]
    Geo_scheduledmonuments, Attr_scheduledmonuments = result["ScheduledMonuments"]
    Geo_parksandgardens, Attr_parksandgardens = result["ParksAndGardens"]
    Geo_battlefields, Attr_battlefields = result["Battlefields"]
    Geo_worldheritagesites, Attr_worldheritagesite = result["WorldHeritageSites"]

except Exception as err:
    import traceback
    error_tree = Grasshopper.DataTree[str]()
    error_tree.Add(str(err), Grasshopper.Kernel.Data.GH_Path(0))
    error_tree.Add(traceback.format_exc(), Grasshopper.Kernel.Data.GH_Path(1))
    Geo_listedbuildings = Geo_scheduledmonuments = Geo_parksandgardens = Geo_battlefields = Geo_worldheritagesite = []
    Attr_listedbuildings = Attr_scheduledmonuments = Attr_parksandgardens = Attr_battlefields = Attr_worldheritagesite = error_tree
# ---------- end historic_england ----------
split = TextSplit(Text=historic_england.Attr_worldheritagesite, Separators=":")
split_2 = TextSplit(Text=historic_england.Attr_battlefields, Separators=":")
split_3 = TextSplit(Text=historic_england.Attr_parksandgardens, Separators=":")
split_4 = TextSplit(Text=historic_england.Attr_listedbuildings, Separators=":")
split_5 = TextSplit(Text=historic_england.Attr_scheduledmonuments, Separators=":")
concat = Concatenate(FragmentA="UC::HE::", FragmentB="World_Heritage_Sites")
trim = TextTrim(Text=split, Start=True, End=True)
concat_2 = Concatenate(FragmentA="UC::HE::", FragmentB="Battlefields")
trim_2 = TextTrim(Text=split_2, Start=True, End=True)
concat_3 = Concatenate(FragmentA="UC::HE::", FragmentB="Parks&Gardens")
trim_3 = TextTrim(Text=split_3, Start=True, End=True)
concat_4 = Concatenate(FragmentA="UC::HE::", FragmentB="Listed_Buildings")
concat_5 = Concatenate(FragmentA="UC::HE::", FragmentB="Scheduled_Monuments")
trim_4 = TextTrim(Text=split_4, Start=True, End=True)
trim_5 = TextTrim(Text=split_5, Start=True, End=True)
object = ModelObject(Geometry=graft(historic_england.Geo_worldheritagesite), Layer=concat)  # -> Object, Geometry, Name, Layer, Visibility, Display, Drafting, Render
object_2 = ModelObject(Geometry=graft(historic_england.Geo_battlefields), Layer=concat_2)  # -> Object, Geometry, Name, Layer, Visibility, Display, Drafting, Render
object_3 = ModelObject(Geometry=graft(historic_england.Geo_parksandgardens), Layer=concat_3)  # -> Object, Geometry, Name, Layer, Visibility, Display, Drafting, Render
object_4 = ModelObject(Geometry=graft(historic_england.Geo_listedbuildings), Layer=concat_4)  # -> Object, Geometry, Name, Layer, Visibility, Display, Drafting, Render
object_5 = ModelObject(Geometry=graft(historic_england.Geo_scheduledmonuments), Layer=concat_5)  # -> Object, Geometry, Name, Layer, Visibility, Display, Drafting, Render
item = ListItem(List=trim, Index=0, Wrap=True)
item_2 = ListItem(List=trim, Index=1, Wrap=True)
item_3 = ListItem(List=trim_2, Index=0, Wrap=True)
item_4 = ListItem(List=trim_2, Index=1, Wrap=True)
item_5 = ListItem(List=trim_3, Index=0, Wrap=True)
item_6 = ListItem(List=trim_3, Index=1, Wrap=True)
item_7 = ListItem(List=trim_4, Index=0, Wrap=True)
item_8 = ListItem(List=trim_4, Index=1, Wrap=True)
item_9 = ListItem(List=trim_5, Index=0, Wrap=True)
item_10 = ListItem(List=trim_5, Index=1, Wrap=True)
pshift = ShiftPaths(Data=item_7, Offset=-1)
pshift_2 = ShiftPaths(Data=item_8, Offset=-1)
pshift_3 = ShiftPaths(Data=item_9, Offset=-1)
pshift_4 = ShiftPaths(Data=item_10, Offset=-1)
pshift_5 = ShiftPaths(Data=item_5, Offset=-1)
pshift_6 = ShiftPaths(Data=item_6, Offset=-1)
pshift_7 = ShiftPaths(Data=item_3, Offset=-1)
pshift_8 = ShiftPaths(Data=item_4, Offset=-1)
pshift_9 = ShiftPaths(Data=item, Offset=-1)
pshift_10 = ShiftPaths(Data=item_2, Offset=-1)
u_text = UserText(Content=object_4.Object, Keys=pshift, Values=pshift_2, UserTextMode=1)  # -> Content, Keys, Values
u_text_2 = UserText(Content=object_5.Object, Keys=pshift_3, Values=pshift_4, UserTextMode=1)  # -> Content, Keys, Values
u_text_3 = UserText(Content=object_3.Object, Keys=pshift_5, Values=pshift_6, UserTextMode=1)  # -> Content, Keys, Values
u_text_4 = UserText(Content=object_2.Object, Keys=pshift_7, Values=pshift_8, UserTextMode=1)  # -> Content, Keys, Values
u_text_5 = UserText(Content=object.Object, Keys=pshift_9, Values=pshift_10, UserTextMode=1)  # -> Content, Keys, Values
c_bake = ContextBake(Content=u_text.Content)
c_bake_2 = ContextBake(Content=u_text_2.Content)
c_bake_3 = ContextBake(Content=u_text_3.Content)
c_bake_4 = ContextBake(Content=u_text_4.Content)
c_bake_5 = ContextBake(Content=u_text_5.Content)
