# Grasshopper definition ISOCHRONES_COMPONENT.gh (Grasshopper 1.0.8)

travel_distance_meters = GetInteger("940", AtLeast=1, AtMost=1, Maximum=2147483647, Minimum=-2147483648, Prompt="Radius of analysis area", TreeAccess=False)
latitude = GetNumber(
    "51.54239",
    AtLeast=1,
    AtMost=1,
    Maximum=1.797693135e+308,
    Minimum=-1.797693135e+308,
    Prompt="Latitude coordinate in the EPSG provided",
    TreeAccess=False)
longitude = GetNumber(
    "-0.05193",
    AtLeast=1,
    AtMost=1,
    Maximum=1.797693135e+308,
    Minimum=-1.797693135e+308,
    Prompt="Lon coordintae in the EPSG provided",
    TreeAccess=False)
travel_mode = GetString("walking", AtLeast=1, AtMost=1, Prompt="Travel Mode (walking, cycling, or public_transport)", TreeAccess=False)
api_key = GetString(
    "7ffe352a7566c181f1777bdeafff1129",
    AtLeast=1,
    AtMost=1,
    Prompt="Travel Mode (walking, cycling, or public_transport)",
    TreeAccess=False)
isochrones = Python3Script(
    Latitude=latitude,
    Longitude=longitude,
    mode=travel_mode,
    API_Key=api_key,
    app_id="fbf6e1a4",
    travel_time=travel_distance_meters)  # -> out, Geo; inputs travel_time: Int32
# ---------- isochrones: Python ----------
#! python 3

# Inputs:
# lat_lng (string): e.g. "51.469174, -0.024684" (in EPSG:4326)
# mode (string): either "public_transport" or "walking"
# travel_time (int): travel time in seconds, e.g. 1200 for 20 minutes
# app_id (string): your TravelTime API app ID
# API_Key (string): your TravelTime API key

import json
import requests
from shapely.geometry import shape, Polygon, MultiPolygon
import Rhino.Geometry as rg
import Grasshopper
import Grasshopper.Kernel as gh
from pyproj import Transformer

def fetch_isochrone_geojson(lat, lng, mode, travel_time, app_id, API_Key):
    url = "https://api.traveltimeapp.com/v4/time-map/fast"
    headers = {
        "Content-Type": "application/json",
        "Accept": "application/geo+json",
        "X-Application-Id": app_id,
        "X-Api-Key": API_Key
    }

    body = {
        "arrival_searches": {
            "one_to_many": [
                {
                    "id": mode,
                    "coords": {"lat": lat, "lng": lon},
                    "arrival_time_period": "weekday_morning",
                    "travel_time": travel_time,
                    "transportation": {"type": mode},
                    "level_of_detail": {
                        "scale_type": "simple",
                        "level": "lowest"
                    }
                }
            ]
        }
    }

    response = requests.post(url, headers=headers, json=body)
    response.raise_for_status()
    return json.loads(response.text)

def to_rhino_geometry(geom):
    if isinstance(geom, Polygon):
        pts = [rg.Point3d(x, y, 0) for x, y in geom.exterior.coords]
        return rg.Polyline(pts).ToNurbsCurve()
    elif isinstance(geom, MultiPolygon):
        curves = []
        for poly in geom.geoms:
            pts = [rg.Point3d(x, y, 0) for x, y in poly.exterior.coords]
            curves.append(rg.Polyline(pts).ToNurbsCurve())
        return curves
    return None

def transform_geometry(geom, from_crs="EPSG:4326", to_crs="EPSG:27700"):
    transformer = Transformer.from_crs(from_crs, to_crs, always_xy=True)
    def project_coords(coords):
        return [transformer.transform(x, y) for x, y in coords]

    if isinstance(geom, Polygon):
        return Polygon(project_coords(geom.exterior.coords))
    elif isinstance(geom, MultiPolygon):
        return MultiPolygon([Polygon(project_coords(poly.exterior.coords)) for poly in geom.geoms])
    return geom

# === MAIN ===
try:
    print("✅ Grasshopper script executing")
    lat = float(Latitude)
    lon = float(Longitude)
    print(f"📍 lat_lngation: lat {lat}, lon {lon}, Mode: {mode}, Travel time: {travel_time}s")

    geojson = fetch_isochrone_geojson(lat, lon, mode, travel_time, app_id, API_Key)

    features = geojson.get("features", [])
    rhino_geoms = []

    for feat in features:
        geom = shape(feat["geometry"])
        geom_proj = transform_geometry(geom)
        rh_geom = to_rhino_geometry(geom_proj)
        if isinstance(rh_geom, list):
            rhino_geoms.extend(rh_geom)
        elif rh_geom:
            rhino_geoms.append(rh_geom)

    Geo = rhino_geoms
    print(f"🟢 Isochrone polygons parsed: {len(rhino_geoms)}")

except Exception as e:
    import traceback
    print(f"❌ Error: {str(e)}")
    tree = Grasshopper.DataTree[str]()
    tree.Add(str(e), gh.Data.GH_Path(0))
    tree.Add(traceback.format_exc(), gh.Data.GH_Path(1))
    Geo = tree
# ---------- end isochrones ----------
panel = Panel(isochrones.Geo)
c_print = ContextPrint(Text=isochrones.out)
concat = Concatenate(FragmentA="UC::Isochrones::", FragmentB=travel_mode)
object = ModelObject(Geometry=isochrones.Geo, Layer=concat)  # -> Object, Geometry, Name, Layer, Visibility, Display, Drafting, Render
c_bake = ContextBake(Content=object.Object)
