# Grasshopper definition LANDSAT_COMPONENT.gh (Grasshopper 1.0.8)

panel = Panel("""Coastal/Aerosol
Blue
Green
Red
Near Infrared (NIR)
SWIR 1
SWIR 2
Panchromatic
Cirrus
Thermal Infrared 1""")
aggregate = GetInteger(
    "1",
    AtLeast=1,
    AtMost=1,
    Maximum=2147483647,
    Minimum=-2147483648,
    Prompt="Number between 1 to 10; Aggregate allows you to reduce the accuracy of the model to speed things up, the higher the number the lower the resolution",
    TreeAccess=False)
bbox = GetString(
    "534690.0,183908.0,535690.0,184908.0",
    AtLeast=1,
    AtMost=1,
    Prompt="BBox (if generated through the BBox component, this should be in the BBox layer attribute information)",
    TreeAccess=False)
landsat_band = GetString(
    "1",
    AtLeast=1,
    AtMost=1,
    Prompt="Select Band; 1=Coastal/Aerosold, 2 = Blue, 3 = Green, 4 = Red, 5 = NIR, 6 = SWIR1, 7 = SWIR2, 8 = Panchromatic, 9 = Cirrus, 10 = TIR",
    TreeAccess=False)
subtraction = Subtraction(A=aggregate, B="1")
panel_2 = Panel("1")
landsat = Python3Script(BBox=bbox, Band=landsat_band, Pixels="250", Agg=aggregate)  # -> out, a; inputs BBox: String, Band: Int32, Pixels: Int32, Agg: Int32
# ---------- landsat: Python ----------
#! python 3
# r: rasterio

import requests
import math
from rasterio.io import MemoryFile
from rasterio.windows import from_bounds
import Rhino.Geometry as rg

def download_landsat_band_pointcloud(bbox_str, band_id, size=1000, agg=1):
    # Parse BBox
    minx, miny, maxx, maxy = map(float, bbox_str.split(","))
    bbox = [minx, miny, maxx, maxy]

    # Step 1: Request raster TIFF URL
    print(f"📦 Downloading band {band_id} for bbox {bbox} at {size}x{size} resolution")
    url = (
        f"https://landsat2.arcgis.com/arcgis/rest/services/Landsat8_Views/ImageServer/exportImage"
        f"?bbox={bbox[0]}%2C{bbox[1]}%2C{bbox[2]}%2C{bbox[3]}"
        f"&bboxSR=27700&size={size},{size}&imageSR=27700&format=tiff"
        f"&pixelType=S16&noData=&noDataInterpretation=esriNoDataMatchAny"
        f"&interpolation=RSP_BilinearInterpolation&bandIds={band_id}"
        f"&adjustAspectRatio=true&f=pjson"
    )

    r = requests.get(url)
    r.raise_for_status()
    tiff_url = r.json().get("href", None)
    if not tiff_url:
        raise Exception("❌ No TIFF URL returned")

    # Step 2: Download raster to memory
    r_tiff = requests.get(tiff_url)
    r_tiff.raise_for_status()
    print("✅ TIFF downloaded")

    # Step 3: Read and convert to PointCloud
    with MemoryFile(r_tiff.content) as memfile:
        with memfile.open() as dataset:
            data = dataset.read(1)
            transform = dataset.transform
            pc = rg.PointCloud()
            for row in range(0, data.shape[0], agg):
                for col in range(0, data.shape[1], agg):
                    z = float(data[row, col])
                    if math.isnan(z): continue
                    x = transform.c + col * transform.a
                    y = transform.f + row * transform.e
                    pt = rg.Point3d(x, y, z)
                    pc.Add(pt)
    return pc

try:
    pc = download_landsat_band_pointcloud(BBox, Band, size=Pixels, agg=Agg)
    a = [pc]
except Exception as e:
    print(f"❌ Error: {str(e)}")
    a = None
# ---------- end landsat ----------
item = ListItem(List=panel, Index=subtraction, Wrap=True)
pcloud = PointCloud(landsat.a)
point_cloud = PointCloudAttributes(Cloud=pcloud)  # -> Cloud, Locations, Normals, Colours, Extra, Hidden
concat = Concatenate(FragmentA="UC::LANDSAT::", FragmentB=item)
del = DelaunayMesh(Points=point_cloud.Locations, Plane=PlaneXY(0, 0, 0))
object = ModelObject(Geometry=del, Layer=concat)  # -> Object, Geometry, Name, Layer, Visibility, Display, Drafting, Render
c_bake = ContextBake(Content=object.Object)
