# Grasshopper definition OSM_COMPONENT.gh (Grasshopper 1.0.8)

epsg_in = GetInteger(
    "4326",
    AtLeast=1,
    AtMost=1,
    Maximum=2147483647,
    Minimum=-2147483648,
    Prompt="EPSG code from your Lat and Lon coordinates",
    TreeAccess=False)
latitude = GetNumber(
    "51.54239",
    AtLeast=1,
    AtMost=1,
    Maximum=1.797693135e+308,
    Minimum=-1.797693135e+308,
    Prompt="Latitude Coordinate in your defined EPSG_in step",
    TreeAccess=False)
longitude = GetNumber(
    "-0.05193",
    AtLeast=1,
    AtMost=1,
    Maximum=1.797693135e+308,
    Minimum=-1.797693135e+308,
    Prompt="Longitude Coordinate in your defined EPSG_in step",
    TreeAccess=False)
epsg_out = GetInteger(
    "27700",
    AtLeast=1,
    AtMost=1,
    Maximum=2147483647,
    Minimum=-2147483648,
    Prompt="EPSG code to re-project geometry to",
    TreeAccess=False)
radius = GetInteger("500", AtLeast=1, AtMost=1, Maximum=2147483647, Minimum=-2147483648, Prompt="Analysis radious", TreeAccess=False)
osm_data = Python3Script(EPSG_in=epsg_in, lat=latitude, lon=longitude, EPSG_out=epsg_out, rad=radius)  # -> out, Geo, Attr; inputs lat: String, rad: Int32
# ---------- osm_data: Python ----------
#! python 3
#r: shapely, pyproj

import requests
import csv
import io
from shapely.geometry import Point
from Rhino.Geometry import Point3d
from pyproj import Transformer, CRS
import Grasshopper
import ghpythonlib.treehelpers as th
from Grasshopper import DataTree
from Grasshopper.Kernel.Data import GH_Path
import math

csv_text = """Key,Value,Sub-Category,Category
amenity,bar,food&beverage,f&b
amenity,biergarten,food&beverage,f&b
amenity,cafe,food&beverage,f&b
amenity,fast_food,food&beverage,f&b
amenity,food_court,food&beverage,f&b
amenity,ice_cream,food&beverage,f&b
amenity,pub,food&beverage,f&b
amenity,restaurant,food&beverage,f&b
amenity,college,education_over16,education
amenity,dancing_school,education_specialised,education
amenity,driving_school,education_specialised,education
amenity,first_aid_school,education_specialised,education
amenity,kindergarten,education_1to4,education
amenity,language_school,education_specialised,education
amenity,library,culture,cultural
amenity,surf_school,education_specialised,education
amenity,toy_library,culture,cultural
amenity,research_institute,office,office
amenity,training,education,education
amenity,music_school,education_specialised,education
amenity,school,education_5to16,education
amenity,traffic_park,education_specialised,education
amenity,university,education_over16,education
amenity,bicycle_parking,bike,mobility
amenity,bicycle_repair_station,outdoors_sport_vehicles,shopping
amenity,bicycle_rental,bike,mobility
amenity,bus_station,public_transport,mobility
amenity,car_rental,transportation,mobility
amenity,car_sharing,transportation,mobility
amenity,car_wash,transportation,other
amenity,compressed_air,transportation,other
amenity,vehicle_inspection,transportation,other
amenity,charging_station,transportation,other
amenity,driver_training,transportation,education
amenity,ferry_terminal,transportation,mobility
amenity,fuel,transportation,other
amenity,grit_bin,transportation,other
amenity,motorcycle_parking,transportation,mobility
amenity,parking,transportation,mobility
amenity,parking_entrance,transportation,other
amenity,parking_space,transportation,mobility
amenity,taxi,transportation,mobility
amenity,weighbridge,transportation,other
amenity,atm,financial,financial
amenity,payment_terminal,financial,financial
amenity,bank,financial,financial
amenity,bureau_de_change,financial,financial
amenity,money_transfer,financial,financial
amenity,payment_centre,financial,financial
amenity,baby_hatch,healthcare,healthcare
amenity,clinic,healthcare,healthcare
amenity,dentist,healthcare,healthcare
amenity,doctors,healthcare,healthcare
amenity,hospital,healthcare,healthcare
amenity,nursing_home,healthcare,healthcare
amenity,pharmacy,healthcare_support,healthcare
amenity,social_facility,healthcare_support,healthcare
amenity,veterinary,healthcare_animals,healthcare
amenity,arts_centre,culture,cultural
amenity,brothel,adult_entertainment,leisure
amenity,casino,adult_entertainment,leisure
amenity,cinema,culture,cultural
amenity,community_centre,culture,cultural
amenity,conference_centre,events,events
amenity,events_venue,events,events
amenity,exhibition_centre,events,events
amenity,gambling,adult_entertainment,leisure
amenity,love_hotel,adult_entertainment,leisure
amenity,music_venue,culture,cultural
amenity,nightclub,adult_entertainment,leisure
amenity,planetarium,culture,cultural
amenity,public_bookcase,culture,cultural
amenity,social_centre,social,cultural
amenity,stage,culture,cultural
amenity,stripclub,adult_entertainment,leisure
amenity,studio,culture,cultural
amenity,swingerclub,adult_entertainment,leisure
amenity,theatre,culture,cultural
amenity,courthouse,public_service,civic
amenity,fire_station,public_service,civic
amenity,police,public_service,civic
amenity,post_box,public_service,civic
amenity,post_depot,public_service,civic
amenity,post_office,public_service,civic
amenity,prison,public_service,civic
amenity,ranger_station,public_service,civic
amenity,townhall,public_service,civic
amenity,animal_boarding,others,other
amenity,animal_breeding,others,other
amenity,animal_shelter,others,other
amenity,animal_training,others,other
amenity,crematorium,others,other
amenity,dive_centre,others,other
amenity,funeral_hall,others,other
amenity,grave_yard,others,green_spaces
amenity,hunting_stand,others,other
amenity,internet_cafe,others,shopping_essential
amenity,kitchen,others,other
amenity,kneipp_water_cure,others,other
amenity,lounger,others,other
amenity,marketplace,others,shopping_essential
amenity,monastery,others,other
amenity,mortuary,others,other
amenity,photo_booth,others,other
amenity,place_of_mourning,others,other
amenity,place_of_worship,others,religion
amenity,public_bath,others,other
amenity,public_building,others,civic
amenity,refugee_site,others,other
amenity,vending_machine,others,other
amenity,user defined,others,other
shop,alcohol,food_supply,shopping_essential
shop,bakery,food_supply,shopping_essential
shop,beverages,food_supply,shopping_essential
shop,brewing_supplies,food_supply,shopping_essential
shop,butcher,food_supply,shopping_essential
shop,cheese,food_supply,shopping_essential
shop,chocolate,food_supply,shopping_essential
shop,coffee,food_supply,shopping_essential
shop,confectionery,food_supply,shopping_essential
shop,convenience,food_supply,shopping_essential
shop,dairy,food_supply,shopping_essential
shop,deli,food_supply,shopping_essential
shop,farm,food_supply,shopping_essential
shop,food,food_supply,shopping_essential
shop,frozen_food,food_supply,shopping_essential
shop,greengrocer,food_supply,shopping_essential
shop,health_food,food_supply,shopping_essential
shop,ice_cream,food&beverage,f&b
shop,nuts,food_supply,shopping_essential
shop,pasta,food_supply,shopping_essential
shop,pastry,food_supply,shopping_essential
shop,seafood,food_supply,shopping_essential
shop,spices,food_supply,shopping_essential
shop,tea,food_supply,shopping_essential
shop,tortilla,food_supply,shopping_essential
shop,water,food_supply,shopping_essential
shop,wine,food_supply,shopping_essential
shop,department_store,large_commercial,shopping_essential
shop,general,retail,shopping_essential
shop,kiosk,everyday_essential,shopping_essential
shop,mall,large_commercial,shopping
shop,supermarket,food_supply,shopping_essential
shop,wholesale,large_commercial,shopping_essential
shop,baby_goods,retail,shopping
shop,bag,retail,shopping
shop,boutique,retail,shopping
shop,clothes,retail,shopping
shop,fabric,retail,shopping
shop,fashion,retail,shopping
shop,fashion_accessories,retail,shopping
shop,jewelry,retail,shopping
shop,leather,retail,shopping
shop,sewing,everyday_essential,shopping_essential
shop,shoes,retail,shopping
shop,shoe_repair,everyday_essential,shopping_essential
shop,tailor,retail,shopping
shop,watches,retail,shopping
shop,wool,retail,shopping
shop,charity,others,shopping
shop,second_hand,others,shopping
shop,variety_store,everyday_essential,shopping_essential
shop,beauty,health_beauty,shopping
shop,chemist,health_beauty,shopping
shop,cosmetics,health_beauty,shopping
shop,erotic,health_beauty,shopping
shop,hairdresser,health_beauty,shopping_essential
shop,hairdresser_supply,health_beauty,shopping_essential
shop,hearing_aids,health_beauty,shopping_essential
shop,herbalist,health_beauty,shopping_essential
shop,massage,health_beauty,shopping
shop,medical_supply,health_beauty,shopping_essential
shop,nutrition_supplements,health_beauty,shopping_essential
shop,optician,health_beauty,shopping_essential
shop,perfumery,health_beauty,shopping
shop,tattoo,health_beauty,shopping
shop,agrarian,building_material,shopping_essential
shop,appliance,building_material,shopping_essential
shop,bathroom_furnishing,building_material,shopping_essential
shop,country_store,building_material,shopping_essential
shop,doityourself,building_material,shopping_essential
shop,electrical,building_material,shopping_essential
shop,energy,building_material,shopping_essential
shop,fireplace,building_material,shopping_essential
shop,florist,retail,shopping
shop,garden_centre,building_material,shopping_essential
shop,garden_furniture,building_material,shopping_essential
shop,gas,building_material,shopping_essential
shop,glaziery,building_material,shopping_essential
shop,groundskeeping,building_material,shopping_essential
shop,hardware,building_material,shopping_essential
shop,houseware,building_material,shopping_essential
shop,locksmith,building_material,shopping_essential
shop,paint,building_material,shopping_essential
shop,pottery,retail,shopping
shop,security,building_material,shopping_essential
shop,tool_hire,building_material,shopping_essential
shop,trade,building_material,shopping_essential
shop,antiques,furniture,shopping
shop,bed,furniture,shopping_essential
shop,candles,furniture,shopping_essential
shop,carpet,furniture,shopping_essential
shop,curtain,furniture,shopping_essential
shop,doors,furniture,shopping_essential
shop,flooring,furniture,shopping_essential
shop,furniture,furniture,shopping_essential
shop,household_linen,furniture,shopping_essential
shop,interior_decoration,furniture,shopping_essential
shop,kitchen,furniture,shopping_essential
shop,lighting,furniture,shopping_essential
shop,tiles,furniture,shopping_essential
shop,window_blind,furniture,shopping_essential
shop,computer,electronics,shopping_essential
shop,electronics,electronics,shopping
shop,hifi,electronics,shopping
shop,mobile_phone,electronics,shopping
shop,printer_ink,electronics,shopping_essential
shop,radiotechnics,electronics,shopping_essential
shop,telecommunication,electronics,shopping_essential
shop,vacuum_cleaner,electronics,shopping_essential
shop,atv,outdoors_sport_vehicles,shopping
shop,bicycle,outdoors_sport_vehicles,shopping
shop,boat,outdoors_sport_vehicles,shopping
shop,car,outdoors_sport_vehicles,shopping
shop,car_parts,outdoors_sport_vehicles,shopping_essential
shop,car_repair,outdoors_sport_vehicles,shopping_essential
shop,fishing,outdoors_sport_vehicles,shopping
shop,fuel,outdoors_sport_vehicles,shopping_essential
shop,golf,outdoors_sport_vehicles,shopping
shop,hunting,outdoors_sport_vehicles,shopping
shop,military_surplus,outdoors_sport_vehicles,shopping_essential
shop,motorcycle,outdoors_sport_vehicles,shopping
shop,motorcycle_repair,outdoors_sport_vehicles,shopping_essential
shop,outdoor,outdoors_sport_vehicles,shopping
shop,scuba_diving,outdoors_sport_vehicles,shopping
shop,ski,outdoors_sport_vehicles,shopping
shop,snowmobile,outdoors_sport_vehicles,shopping
shop,sports,outdoors_sport_vehicles,shopping
shop,surf,outdoors_sport_vehicles,shopping
shop,swimming_pool,outdoors_sport_vehicles,shopping
shop,trailer,outdoors_sport_vehicles,shopping_essential
shop,truck,outdoors_sport_vehicles,shopping_essential
shop,tyres,outdoors_sport_vehicles,shopping_essential
shop,art,art_music_hobbies,shopping
shop,camera,art_music_hobbies,shopping
shop,collector,art_music_hobbies,shopping
shop,craft,art_music_hobbies,shopping
shop,frame,art_music_hobbies,shopping
shop,games,art_music_hobbies,shopping
shop,model,art_music_hobbies,shopping
shop,music,art_music_hobbies,shopping
shop,musical_instrument,art_music_hobbies,shopping
shop,photo,art_music_hobbies,shopping
shop,trophy,art_music_hobbies,shopping
shop,video,art_music_hobbies,shopping
shop,video_games,art_music_hobbies,shopping
shop,anime,others,shopping
shop,books,others,shopping
shop,gift,others,shopping
shop,lottery,others,shopping
shop,newsagent,others,shopping_essential
shop,stationery,others,shopping_essential
shop,ticket,others,shopping
shop,bookmaker,others,shopping
shop,cannabis,others,shopping
shop,copyshop,others,shopping_essential
shop,dry_cleaning,others,shopping_essential
shop,e-cigarette,others,shopping_essential
shop,funeral_directors,others,shopping
shop,laundry,others,shopping_essential
shop,money_lender,others,other
shop,outpost,others,other
shop,party,others,other
shop,pawnbroker,others,other
shop,pest_control,others,other
shop,pet,others,shopping
shop,pet_grooming,others,shopping_essential
shop,pyrotechnics,others,other
shop,religion,others,other
shop,rental,others,other
shop,storage_rental,others,other
shop,tobacco,others,shopping_essential
shop,toys,others,shopping
shop,travel_agency,others,shopping
shop,vacant,others,other
shop,weapons,others,other
shop,yes,others,other
building,apartments,residential,residential
building,barracks,residential,residential
building,bungalow,residential,residential
building,cabin,residential,residential
building,detached,residential,residential
building,annexe,residential,residential
building,dormitory,residential,residential
building,farm,residential,residential
building,ger,residential,residential
building,hotel,residential,residential
building,house,residential,residential
building,houseboat,residential,residential
building,residential,residential,residential
building,semidetached_house,residential,residential
building,static_caravan,residential,residential
building,stilt_house,residential,residential
building,terrace,residential,residential
building,tree_house,residential,residential
building,trullo,residential,residential
building,commercial,office,office
building,industrial,industrial,office
building,kiosk,others,shopping_essential
building,office,office,office
building,retail,clothing,shopping
building,supermarket,food,shopping_essential
building,warehouse,office,office
building,religious,religious,religion
building,cathedral,religious,religion
building,chapel,religious,religion
building,church,religious,religion
building,kingdom_hall,religious,religion
building,monastery,religious,religion
building,mosque,religious,religion
building,presbytery,religious,religion
building,shrine,religious,religion
building,synagogue,religious,religion
building,temple,religious,religion
building,civic,civic,civic
building,college,education_over16,education
building,fire_station,civic,civic
building,government,office,office
building,hospital,healthcare,healthcare
building,kindergarten,education_1to4,education
building,museum,culture,cultural
building,public,office,office
building,school,education_5to16,education
building,train_station,public_transport,mobility
building,transportation,civic,civic
building,university,education_over16,education
building,barn,agricultural,other
building,conservatory,other,other
building,cowshed,agricultural,other
building,farm_auxiliary,agricultural,other
building,greenhouse,agricultural,other
building,slurry_tank,agricultural,other
building,stable,agricultural,other
building,sty,agricultural,other
building,livestock,agricultural,other
building,grandstand,culture,cultural
building,pavilion,sports,sports
building,riding_hall,sports,sports
building,sports_hall,sports,sports
building,sports_centre,sports,sports
building,stadium,events,events
building,allotment_house,storage,other
building,boathouse,storage,other
building,hangar,storage,other
building,hut,storage,other
building,shed,storage,other
building,carport,cars,other
building,garage,cars,other
building,garages,cars,other
building,parking,cars,other
building,digester,power,other
building,service,power,other
building,tech_cab,power,other
building,transformer_tower,power,other
building,water_tower,power,other
building,storage_tank,power,other
building,silo,power,other
building,beach_hut,other_buildings,other
building,bunker,other_buildings,other
building,castle,other_buildings,other
building,construction,other_buildings,other
building,container,other_buildings,other
building,guardhouse,other_buildings,other
building,military,other_buildings,other
building,outbuilding,other_buildings,other
building,pagoda,other_buildings,other
building,quonset_hut,other_buildings,other
building,roof,other_buildings,other
building,ruins,other_buildings,other
building,ship,other_buildings,other
building,tent,other_buildings,other
building,tower,other_buildings,other
building,triumphal_arch,other_buildings,other
building,windmill,other_buildings,other
building,yes,residential,residential
public_transport,stop_position,public_transport,mobility
public_transport,platform,public_transport,mobility
railway,platform,public_transport,mobility
public_transport,station,public_transport,mobility
railway,station,public_transport,mobility
railway,stop,public_transport,mobility
railway,subway_entrance,public_transport,mobility
railway,tram_stop,public_transport,mobility
office,accountant,office,office
office,advertising_agency,office,office
office,airline,office,office
office,architect,office,office
office,association,office,office
office,broadcaster,office,office
office,chamber,office,office
office,charity,office,office
office,company,office,office
office,construction_company,office,office
office,consulting,office,office
office,courier,office,office
office,coworking,office,office
office,diplomatic,office,office
office,educational_institution,office,office
office,employment_agency,office,office
office,energy_supplier,office,office
office,engineer,office,office
office,estate_agent,office,office
office,event_management,office,office
office,financial,office,office
office,financial_advisor,office,office
office,forestry,office,office
office,foundation,office,office
office,geodesist,office,office
office,government,office,office
office,graphic_design,office,office
office,guide,office,office
office,harbour_master,office,office
office,insurance,office,office
office,it,office,office
office,lawyer,office,office
office,logistics,office,office
office,moving_company,office,office
office,newspaper,office,office
office,ngo,office,office
office,notary,office,office
office,politician,office,office
office,political_party,office,office
office,property_management,office,office
office,publisher,office,office
office,quango,office,office
office,religion,office,office
office,research,office,office
office,security,office,office
office,surveyor,office,office
office,tax_advisor,office,office
office,telecommunication,office,office
office,transport,office,office
office,travel_agent,office,office
office,tutoring,office,office
office,union,office,office
office,university,office,office
office,visa,office,office
office,water_utility,office,office
office,yes,office,office
leisure,adult_gaming_centre,adult_entertainment,leisure
leisure,amusement_arcade,entertainment,leisure
leisure,beach_resort,leisure,leisure
leisure,bandstand,culture,cultural
leisure,bird_hide,leisure,leisure
leisure,common,parks,green_spaces
leisure,dance,entertainment,leisure
leisure,disc_golf_course,enterteinment,leisure
leisure,dog_park,parks,green_spaces
leisure,escape_game,enterteinment,leisure
leisure,fishing,sports,sports
leisure,fitness_centre,sports,sports
leisure,fitness_station,sports,sports
leisure,garden,parks,green_spaces
leisure,hackerspace,entertainment,leisure
leisure,horse_riding,sports,sports
leisure,ice_rink,sports,sports
leisure,marina,leisure,leisure
leisure,miniature_golf,entertainment,leisure
leisure,nature_reserve,nature,green_spaces
leisure,park,parks,green_spaces
leisure,pitch,sports,sports
leisure,playground,entertainment,leisure
leisure,sports_centre,sports,sports
leisure,stadium,events,events
leisure,summer_camp,leisure,leisure
leisure,swimming_area,leisure,leisure
leisure,swimming_pool,sports,sports
leisure,track,sports,sports
leisure,water_park,leisure,leisure
tourism,alpine_hut,hotel,hotel
tourism,apartment,hotel,hotel
tourism,aquarium,leisure,leisure
tourism,artwork,culture,cultural
tourism,attraction,tourism,leisure
tourism,chalet,hotel,hotel
tourism,gallery,culture,cultural
tourism,guest_house,hotel,hotel
tourism,hostel,hotel,hotel
tourism,hotel,hotel,hotel
tourism,information,tourism,other
tourism,motel,hotel,hotel
tourism,museum,culture,cultural
tourism,theme_park,leisure,leisure
tourism,wilderness_hut,hotel,hotel
tourism,zoo,leisure,leisure"""

try:
    # Inputs (from Grasshopper)
    radius = float(rad)
    epsg_from = f"EPSG:{int(EPSG_in)}"
    epsg_to = f"EPSG:{int(EPSG_out)}"

    print("📍 Parsing input coordinates...")
    print(f"→ lat: {lat}, lon: {lon}, radius: {radius}m")

    # Prepare transformer
    transformer = Transformer.from_crs(epsg_from, epsg_to, always_xy=True)

    # Load CSV tag dictionary
    print("📄 Reading CSV data from inline text...")

    reader = csv.DictReader(io.StringIO(csv_text))
    tag_set = set()
    tag_info = {}
    for row in reader:
        key = row["Key"]
        value = row["Value"]
        tag_set.add((key, value))
        tag_info[(key, value)] = {
            "category": row.get("Category", ""),
            "sub_category": row.get("Sub-Category", "")
        }

    print(f"→ Loaded {len(tag_set)} unique tag mappings.")

    # Build Overpass query
    print("🌐 Building Overpass query...")
    query = f"""
    [out:json][timeout:25];
    (
        node(around:{radius},{lat},{lon});
        way(around:{radius},{lat},{lon});
        relation(around:{radius},{lat},{lon});
    );
    out center tags;
    """

    # Query Overpass API
    print("📡 Sending Overpass API request...")
    response = requests.post("https://overpass-api.de/api/interpreter", data={"data": query})
    data = response.json()

    print(f"✅ Retrieved {len(data['elements'])} OSM elements.")

    # Parse and project elements
    Geo = []
    Attr = DataTree[object]()

    matched_count = 0
    skipped_count = 0

    for el in data["elements"]:
        tags = el.get("tags", {})
        geom = None

        if el["type"] == "node":
            geom = Point(el["lon"], el["lat"])
        elif "center" in el:
            geom = Point(el["center"]["lon"], el["center"]["lat"])

        if geom is None:
            skipped_count += 1
            continue

        match = next(((k, v) for k, v in tags.items() if (k, v) in tag_set), None)

        if not match:
            skipped_count += 1
            continue

        # Transform coordinates
        x_proj, y_proj = transformer.transform(geom.x, geom.y)
        Geo.append(Point3d(x_proj, y_proj, 0))

        # Build attributes tree
        info = tag_info.get(match, {})
        attr_path = GH_Path(matched_count)
        Attr.Add(f"key: {match[0]}", attr_path)
        Attr.Add(f"value: {match[1]}", attr_path)
        Attr.Add(f"category: {info.get('category', '')}", attr_path)
        Attr.Add(f"sub_category: {info.get('sub_category', '')}", attr_path)

        matched_count += 1

    print(f"✅ Converted {matched_count} features.")
    print(f"⏭️ Skipped {skipped_count} unmatched or null-geometry elements.")

except Exception as e:
    print(f"❌ Error: {str(e)}")
    Geo = []
    Attr = None
# ---------- end osm_data ----------
split = TextSplit(Text=osm_data.Attr, Separators=":")
c_print = ContextPrint(Text=osm_data.out)
trim = TextTrim(Text=split, Start=True, End=True)
item = ListItem(List=trim, Index=0, Wrap=True)
item_2 = ListItem(List=trim, Index=1, Wrap=True)
pshift = ShiftPaths(Data=item, Offset=-1)
pshift_2 = ShiftPaths(Data=item_2, Offset=-1)
object = ModelObject(Geometry=osm_data.Geo, Layer="UC::OSM_Activities")  # -> graft(Object), Geometry, Name, Layer, Visibility, Display, Drafting, Render
u_text = UserText(Content=object.Object, Keys=pshift, Values=pshift_2, UserTextMode=1)  # -> Content, Keys, Values
c_bake = ContextBake(Content=u_text.Content)
