# Grasshopper definition OS_COMPONENT.gh (Grasshopper 1.0.8)

panel = Panel("534690.1412270825,183908.48599042976,535690.1412270825,184908.48599042976")
layer_to_load = GetString(
    "LocalBuildings",
    AtLeast=1,
    AtMost=1,
    Prompt="options = ('Airports', 'Boundaries', 'ETL,' 'Foreshore', 'Greenspace', 'NationalParks', 'Rail', 'RoadsLocal', 'RoadsNational', 'RoadsRegional', 'Sites', 'Surfacewater', 'Waterlines', 'Woodland', 'LocalBuildings')",
    TreeAccess=False)
bbox = GetString(panel, AtLeast=1, AtMost=1, Prompt="BBox in EPSG: 27700", TreeAccess=False)
concat = Concatenate(FragmentA="Zoomstack_", FragmentB=layer_to_load)
os_data = Python3Script(BBox=bbox, api_key="7A0evj8orT4uPEd51Y0wVTf6aABKvbmm", dataset=concat)  # -> out, Geo, Attr; inputs BBox: String, api_key: String
# ---------- os_data: Python ----------
#! python 3
# r: shapely, requests

import Rhino.Geometry as rg
#import geopandas as gpd
import requests
import json
#import pandas as pd
import shapely
import System
from shapely.geometry import shape
import Grasshopper
import Grasshopper.Kernel.Data as gh_data

def parse_geojson_features(geojson_text):
    try:
        geojson = json.loads(geojson_text)
        features = geojson.get("features", [])
        geometries = []
        attributes = []

        for feat in features:
            try:
                geom = shape(feat["geometry"])
                props = feat.get("properties", {})

                # POINT
                if geom.geom_type == 'Point':
                    pt = rg.Point3d(geom.x, geom.y, 0)
                    geometries.append(pt)
                    attributes.append(props)

                # LINESTRING
                elif geom.geom_type == 'LineString':
                    pts = [rg.Point3d(x, y, 0) for x, y in geom.coords]
                    poly = rg.Polyline(pts)
                    if poly.IsValid and poly.Count > 1:
                        geometries.append(poly.ToNurbsCurve())
                        attributes.append(props)

                # MULTILINESTRING
                elif geom.geom_type == 'MultiLineString':
                    for line in geom.geoms:
                        pts = [rg.Point3d(x, y, 0) for x, y in line.coords]
                        poly = rg.Polyline(pts)
                        if poly.IsValid and poly.Count > 1:
                            geometries.append(poly.ToNurbsCurve())
                            attributes.append(props)

                # POLYGON
                elif geom.geom_type == 'Polygon':
                    coords = list(geom.exterior.coords)
                    poly = rg.Polyline([rg.Point3d(x, y, 0) for x, y in coords])
                    if poly.IsValid and poly.Count > 1:
                        geometries.append(poly.ToNurbsCurve())
                        attributes.append(props)

                # MULTIPOLYGON
                elif geom.geom_type == 'MultiPolygon':
                    for p in geom.geoms:
                        coords = list(p.exterior.coords)
                        poly = rg.Polyline([rg.Point3d(x, y, 0) for x, y in coords])
                        if poly.IsValid and poly.Count > 1:
                            geometries.append(poly.ToNurbsCurve())
                            attributes.append(props)

            except Exception as parse_error:
                print("Parse error:", parse_error)
                continue

        print(f"Parsed {len(geometries)} geometries.")
        return geometries, attributes

    except Exception as e:
        print("GeoJSON parse error:", e)
        return [], []

# Main logic
try:
    all_geometries = []
    all_attributes = []

    for i in range(10000):
        start_index = (i * 100) + 1
        url = "https://api.os.uk/features/v1/wfs"
        params = {
            "service": "wfs",
            "version": "2.0.0",
            "request": "GetFeature",
            "typeNames": dataset,
            "count": 100,
            "startIndex": start_index,
            "key": api_key,
            "bbox": BBox,
            "srsName": "EPSG:27700",
            "outputFormat": "GeoJSON"
        }

        response = requests.get(url, params=params)
        if response.status_code != 200:
            print(f"Request failed at index {start_index}: {response.status_code}")
            break

        geoms, props = parse_geojson_features(response.text)
        if not geoms:
            break

        all_geometries.extend(geoms)
        all_attributes.extend(props)

        if len(geoms) < 100:
            break

    # Output geometry
    Geo = all_geometries

    # Output attributes as DataTree
    tree = Grasshopper.DataTree[object]()
    for i, attr_dict in enumerate(all_attributes):
        path = gh_data.GH_Path(i)
        for key, val in attr_dict.items():
            tree.Add(f"{key}: {val}", path)

    Attr = tree

except Exception as error:
    geo = []
    tree = Grasshopper.DataTree[object]()
    path = gh_data.GH_Path(0)
    tree.Add(f"Script error: {str(error)}", path)
    attr = tree
# ---------- end os_data ----------
concat_2 = Concatenate(FragmentA="UC::OS::", FragmentB=layer_to_load)
geo = Geometry(os_data.Geo)
object = ModelObject(Geometry=graft(geo), Layer=concat_2)  # -> Object, Geometry, Name, Layer, Visibility, Display, Drafting, Render
split = TextSplit(Text=os_data.Attr, Separators=":")
trim = TextTrim(Text=split, Start=True, End=True)
c_print = ContextPrint(Text=os_data.out)
item = ListItem(List=trim, Index=0, Wrap=True)
item_2 = ListItem(List=trim, Index=1, Wrap=True)
pshift = ShiftPaths(Data=item, Offset=-1)
pshift_2 = ShiftPaths(Data=item_2, Offset=-1)
u_text = UserText(Content=object.Object, Keys=pshift, Values=pshift_2, UserTextMode=1)  # -> Content, Keys, Values
c_bake = ContextBake(Content=u_text.Content)
