# Grasshopper definition V2_BUILDING_HEIGHT_EXTRACTION_COMPONENT.gh (Grasshopper 1.0.8)

footprints = Curve([<curve referenced from the Rhino model> x454])
dtm = Mesh(<mesh referenced from the Rhino model>)
dsm = Mesh(<mesh referenced from the Rhino model>)
dtm_2 = GetGeometry(
    dtm,
    AnnotationTypeFilter=3966,
    AtLeast=1,
    AtMost=1,
    DeleteInput=False,
    Filter=1074081855,
    Prompt="DTM output from LIDAR component",
    TreeAccess=False)
dsm_2 = GetGeometry(
    dsm,
    AnnotationTypeFilter=3966,
    AtLeast=1,
    AtMost=1,
    DeleteInput=False,
    Filter=1074081855,
    Prompt="DSM output from LIDAR component",
    TreeAccess=False)
get_geometry = GetGeometry(footprints, AnnotationTypeFilter=3966, AtLeast=1, AtMost=1, DeleteInput=False, Filter=1074081854, TreeAccess=False)
demesh = DeconstructMesh(Mesh=dsm_2)  # -> Vertices, Faces, Colours, Normals
demesh_2 = DeconstructMesh(Mesh=dtm_2)  # -> Vertices, Faces, Colours, Normals
point_cloud = PointCloudAttributes(Locations=demesh.Vertices)  # -> Cloud, Locations, Normals, Colours, Extra, Hidden
point_cloud_2 = PointCloudAttributes(Locations=demesh_2.Vertices)  # -> Cloud, Locations, Normals, Colours, Extra, Hidden
area = Area(Geometry=get_geometry)  # -> Area, Centroid
py3 = Python3Script(DSM=point_cloud.Cloud, DTM=point_cloud_2.Cloud, Buildings=get_geometry)  # -> out, BuildingHeights; inputs DSM: PointCloud, DTM: PointCloud, Buildings: list of Polyline
# ---------- py3: Python ----------
#! python 3
import math
import statistics
from Rhino.Geometry import Point3d

# ================================
# PARAMETERS
# ================================
resolution = 0.5      # Raster cell size (m)
percentile = 95       # Percentile for building height extraction

# ================================
# HELPER FUNCTIONS
# ================================
def compute_bounds(points):
    """Compute bounding box of the point cloud."""
    min_x = min(p.X for p in points)
    max_x = max(p.X for p in points)
    min_y = min(p.Y for p in points)
    max_y = max(p.Y for p in points)
    return min_x, max_x, min_y, max_y

def rasterize_pointcloud(points, resolution, mode="max"):
    """Convert point cloud to raster grid."""
    min_x, max_x, min_y, max_y = compute_bounds(points)
    cols = int(math.ceil((max_x - min_x) / resolution))
    rows = int(math.ceil((max_y - min_y) / resolution))

    raster = [[None for _ in range(cols)] for _ in range(rows)]
    for p in points:
        c = int((p.X - min_x) / resolution)
        r = int((p.Y - min_y) / resolution)
        if 0 <= r < rows and 0 <= c < cols:
            if raster[r][c] is None:
                raster[r][c] = p.Z
            else:
                if mode == "max":
                    raster[r][c] = max(raster[r][c], p.Z)
                else:
                    raster[r][c] = min(raster[r][c], p.Z)
    return raster, min_x, min_y, rows, cols

def point_in_poly(x, y, poly):
    """Ray casting algorithm to check if point is inside a closed polyline."""
    pts = [poly[i] for i in range(poly.Count)]
    inside = False
    j = len(pts) - 1
    for i in range(len(pts)):
        xi, yi = pts[i].X, pts[i].Y
        xj, yj = pts[j].X, pts[j].Y
        if ((yi > y) != (yj > y)) and (x < (xj - xi) * (y - yi) / ((yj - yi) + 1e-9) + xi):
            inside = not inside
        j = i
    return inside

def extract_heights_from_raster(poly, raster, min_x, min_y, resolution, percentile=95):
    """Extract building height from DHM raster."""
    bb = poly.BoundingBox
    c0 = int((bb.Min.X - min_x) / resolution)
    r0 = int((bb.Min.Y - min_y) / resolution)
    c1 = int((bb.Max.X - min_x) / resolution)
    r1 = int((bb.Max.Y - min_y) / resolution)

    heights = []
    for r in range(max(0, r0), min(len(raster), r1 + 1)):
        for c in range(max(0, c0), min(len(raster[0]), c1 + 1)):
            if raster[r][c] is not None:
                x = min_x + c * resolution + resolution / 2
                y = min_y + r * resolution + resolution / 2
                if point_in_poly(x, y, poly):
                    heights.append(raster[r][c])

    if not heights:
        return None, None, []

    heights.sort()
    median = statistics.median(heights)
    q1 = heights[int(0.25 * len(heights))]
    q3 = heights[int(0.75 * len(heights))]
    iqr = q3 - q1
    filtered = [h for h in heights if (median - 2 * iqr) <= h <= (median + 2 * iqr)]
    if not filtered:
        filtered = heights

    filtered.sort()
    idx = int(len(filtered) * percentile / 100.0)
    idx = min(idx, len(filtered) - 1)
    height_value = filtered[idx]
    return height_value, median, filtered

# ================================
# MAIN EXECUTION
# ================================
try:
    print("🗺️ Rasterizing DSM and DTM...")
    dsm_raster, min_x, min_y, rows, cols = rasterize_pointcloud(DSM, resolution, mode="max")
    dtm_raster, _, _, _, _ = rasterize_pointcloud(DTM, resolution, mode="min")

    # Compute DHM = DSM - DTM
    dhm_raster = [[None for _ in range(cols)] for _ in range(rows)]
    for r in range(rows):
        for c in range(cols):
            if dsm_raster[r][c] is not None and dtm_raster[r][c] is not None:
                dhm_raster[r][c] = dsm_raster[r][c] - dtm_raster[r][c]

    print("🏢 Extracting building heights from DHM...")
    BuildingHeights = []
    for b in Buildings:
        h, _, _ = extract_heights_from_raster(b, dhm_raster, min_x, min_y, resolution, percentile)
        BuildingHeights.append(h if h is not None else 0.0)

    print(f"✅ Processed {len(Buildings)} buildings.")

except Exception as e:
    import traceback
    BuildingHeights = []
    print(f"❌ Error: {e}")
    print(traceback.format_exc())
# ---------- end py3 ----------
Z = UnitZ(Factor=1)
project = ProjectPoint(Point=area.Centroid, Direction=Z, Geometry=dtm_2)  # -> Point, Index
Z_2 = UnitZ(Factor=py3.BuildingHeights)
vec2pt = Vector2Pt(PointA=area.Centroid, PointB=project.Point, Unitize=False)  # -> Vector, Length
move = Move(Geometry=get_geometry, Motion=vec2pt.Vector)  # -> Geometry, Transform
extr = Extrude(Base=move.Geometry, Direction=Z_2)
capex = CapHolesEx(Brep=extr)  # -> Brep, Caps, Solid
c_print = ContextPrint(Text=py3.out)
null = NullItem(Item=capex.Brep)  # -> NullFlags, InvalidFlags, Description
dispatch = Dispatch(List=py3.BuildingHeights, DispatchPattern=null.NullFlags)  # -> ListA, ListB
dispatch_2 = Dispatch(List=capex.Brep, DispatchPattern=null.NullFlags)  # -> ListA, ListB
object = ModelObject(Geometry=dispatch_2.ListB, Layer="UC::MODEL::BUILDINGS")  # -> Object, Geometry, Name, Layer, Visibility, Display, Drafting, Render
u_text = UserText(Content=object.Object, Keys="Height", Values=dispatch.ListB, UserTextMode=1)  # -> Content, Keys, Values
c_bake = ContextBake(Content=u_text.Content)
panel = Panel(py3.out)
