# Grasshopper definition V2_LANDSAT_BAI.gh (Grasshopper 1.0.8)

swir1 = GetGeometry(
    AnnotationTypeFilter=3966,
    AtLeast=1,
    AtMost=1,
    DeleteInput=False,
    Filter=32,
    Prompt="SWIR1 band from the LANDSAT component",
    TreeAccess=False)
red = GetGeometry(
    AnnotationTypeFilter=3966,
    AtLeast=1,
    AtMost=1,
    DeleteInput=False,
    Filter=32,
    Prompt="RED band from the LANDSAT component",
    TreeAccess=False)
demesh = DeconstructMesh(Mesh=swir1)  # -> Vertices, Faces, Colours, Normals
demesh_2 = DeconstructMesh(Mesh=red)  # -> Vertices, Faces, Colours, Normals
pdecon = Deconstruct(Point=demesh.Vertices)  # -> XComponent, YComponent, ZComponent
pdecon_2 = Deconstruct(Point=demesh_2.Vertices)  # -> XComponent, YComponent, ZComponent
expression = Expression(SWIR1=pdecon.ZComponent, RED=pdecon_2.ZComponent, Expression="(RED-SWIR1) / (RED+SWIR1)")
pt = ConstructPoint(XCoordinate=pdecon.XComponent, YCoordinate=pdecon.YComponent, ZCoordinate=expression)
bnd = Bounds(Numbers=expression)
del = DelaunayMesh(Points=pt, Plane=PlaneXY(0, 0, 0))
dedomain = DeconstructDomain(Domain=bnd)  # -> Start, End
gradient = Gradient(
    LowerLimit=dedomain.Start,
    UpperLimit=dedomain.End,
    Parameter=expression,
    stops=[0: RGB(0, 104, 55), 0.5: RGB(255, 255, 153), 1: RGB(177, 89, 40)])
panel = Panel("""BAI (Burned Area Index) is a spectral index used to detect and map burned or fire-affected areas in satellite imagery. It highlights charred vegetation and ash-covered soil by using the red and near-infrared (NIR) bands, which respond distinctly after fire events.
​
 
High BAI values indicate burned surfaces.

Low BAI values correspond to healthy vegetation or unburned areas.

Purpose: Detect and monitor fire scars and post-fire effects.

Application: Wildfire assessment, land degradation studies, post-burn recovery monitoring.""")
c_print = ContextPrint(Text=panel)
mcol = MeshColours(Mesh=del, Colours=gradient)
object = ModelObject(Geometry=graft(mcol), Layer="UC::LANDSAT::ANALYSIS::BAI")  # -> Object, Geometry, Name, Layer, Visibility, Display, Drafting, Render
c_bake = ContextBake(Content=object.Object)
