# Grasshopper definition V2_LANDSAT_BSI.gh (Grasshopper 1.0.8)

blue = GetGeometry(
    AnnotationTypeFilter=3966,
    AtLeast=1,
    AtMost=1,
    DeleteInput=False,
    Filter=32,
    Prompt="BLUE band from the LANDSAT component",
    TreeAccess=False)
demesh = DeconstructMesh(Mesh=blue)  # -> Vertices, Faces, Colours, Normals
nir = GetGeometry(
    AnnotationTypeFilter=3966,
    AtLeast=1,
    AtMost=1,
    DeleteInput=False,
    Filter=32,
    Prompt="NIR band from the LANDSAT component",
    TreeAccess=False)
red = GetGeometry(
    AnnotationTypeFilter=3966,
    AtLeast=1,
    AtMost=1,
    DeleteInput=False,
    Filter=32,
    Prompt="RED band from the LANDSAT component",
    TreeAccess=False)
swir2 = GetGeometry(
    AnnotationTypeFilter=3966,
    AtLeast=1,
    AtMost=1,
    DeleteInput=False,
    Filter=32,
    Prompt="SWIR2 band from the LANDSAT component",
    TreeAccess=False)
pdecon = Deconstruct(Point=demesh.Vertices)  # -> XComponent, YComponent, ZComponent
demesh_2 = DeconstructMesh(Mesh=nir)  # -> Vertices, Faces, Colours, Normals
demesh_3 = DeconstructMesh(Mesh=swir2)  # -> Vertices, Faces, Colours, Normals
demesh_4 = DeconstructMesh(Mesh=red)  # -> Vertices, Faces, Colours, Normals
pdecon_2 = Deconstruct(Point=demesh_2.Vertices)  # -> XComponent, YComponent, ZComponent
pdecon_3 = Deconstruct(Point=demesh_3.Vertices)  # -> XComponent, YComponent, ZComponent
pdecon_4 = Deconstruct(Point=demesh_4.Vertices)  # -> XComponent, YComponent, ZComponent
expression = Expression(
    NIR=pdecon_2.ZComponent,
    SWIR2=pdecon_3.ZComponent,
    BLUE=pdecon.ZComponent,
    RED=pdecon_4.ZComponent,
    Expression="((SWIR2+RED)-(NIR+BLUE))")
expression_2 = Expression(
    NIR=pdecon_2.ZComponent,
    SWIR2=pdecon_3.ZComponent,
    BLUE=pdecon.ZComponent,
    RED=pdecon_4.ZComponent,
    Expression="((SWIR2+RED)+(NIR+BLUE))")
division = Division(A=expression, B=expression_2)
pt = ConstructPoint(XCoordinate=pdecon_2.XComponent, YCoordinate=pdecon_2.YComponent, ZCoordinate=division)
bnd = Bounds(Numbers=division)
panel = Panel("""BSI (Bare Soil Index) is a spectral index used to detect and map bare soil areas by enhancing the contrast between bare land, vegetation, and built-up surfaces. It combines information from visible, near-infrared (NIR), and shortwave infrared (SWIR) bands.

​
 
High BSI values indicate bare or sparsely vegetated soil.

Low or negative values may represent vegetation, water, or urban materials.

Purpose:
Enhance detection of exposed soil and differentiate it from other land cover types.

Applications:
Land degradation studies

Agricultural land preparation

Soil erosion monitoring

Land cover classification in drylands""")
del = DelaunayMesh(Points=pt, Plane=PlaneXY(0, 0, 0))
dedomain = DeconstructDomain(Domain=bnd)  # -> Start, End
gradient = Gradient(
    LowerLimit=dedomain.Start,
    UpperLimit=dedomain.End,
    Parameter=division,
    stops=[0: RGB(0, 104, 55), 0.5: RGB(255, 255, 153), 1: RGB(177, 89, 40)])
mcol = MeshColours(Mesh=del, Colours=gradient)
c_print = ContextPrint(Text=panel)
object = ModelObject(Geometry=graft(mcol), Layer="UC::LANDSAT::ANALYSIS::BSI")  # -> Object, Geometry, Name, Layer, Visibility, Display, Drafting, Render
c_bake = ContextBake(Content=object.Object)
