# Grasshopper definition V2_LANDSAT_COMPONENT.gh (Grasshopper 1.0.8)

bbox = GetString(
    "534690.0,183908.0,535690.0,184908.0",
    AtLeast=1,
    AtMost=1,
    Prompt="BBox (if generated through the BBox component, this should be in the BBox layer attribute information)",
    TreeAccess=False)
landsat_band = GetString(
    "1",
    AtLeast=1,
    AtMost=1,
    Prompt="Select Band; 1=Coastal/Aerosold, 2 = Blue, 3 = Green, 4 = Red, 5 = NIR, 6 = SWIR1, 7 = SWIR2, 8 = Panchromatic, 9 = Cirrus, 10 = TIR",
    TreeAccess=False)
aggregate = GetInteger(
    "1",
    AtLeast=1,
    AtMost=1,
    Maximum=2147483647,
    Minimum=-2147483648,
    Prompt="Number between 1 to 10; Aggregate allows you to reduce the accuracy of the model to speed things up, the higher the number the lower the resolution",
    TreeAccess=False)
year = GetInteger(
    "2022",
    AtLeast=1,
    AtMost=1,
    Maximum=2147483647,
    Minimum=-2147483648,
    Prompt="Select  Year for Data Download",
    TreeAccess=False)
month = GetInteger(
    "8",
    AtLeast=1,
    AtMost=1,
    Maximum=2147483647,
    Minimum=-2147483648,
    Prompt="Select  Month  for Data Download",
    TreeAccess=False)
day = GetInteger(
    "8",
    AtLeast=1,
    AtMost=1,
    Maximum=2147483647,
    Minimum=-2147483648,
    Prompt="Select  Day  for Data Download",
    TreeAccess=False)
int = Integer(month)
int_2 = Integer(day)
format = Format(Format="{0:00}", Culture=127, Data0=int)
format_2 = Format(Format="{0:00}", Culture=127, Data0=int_2)
concat = Concatenate(
    FragmentA=year,
    FragmentB="-",
    FragmentC=format,
    FragmentD="-",
    FragmentE=format_2,
    FragmentF="T00:00:00,",
    FragmentG=year,
    FragmentH="-",
    FragmentI=format,
    FragmentJ="-",
    FragmentK=format_2,
    FragmentL="T23:59:59")
panel = Panel(concat)
panel_2 = Panel("""Coastal/Aerosol
Blue
Green
Red
Near Infrared (NIR)
SWIR 1
SWIR 2
Panchromatic
Cirrus
Thermal Infrared 1""")
subtraction = Subtraction(A=landsat_band, B="1")
landsat = Python3Script(BBox=bbox, Band=landsat_band, Pixels="250", Agg=aggregate, Time=panel)  # -> out, a; inputs BBox: String, Band: Int32, Pixels: Int32, Agg: Int32
# ---------- landsat: Python ----------
#! python 3
# r: rasterio

import requests
import math
from rasterio.io import MemoryFile
import Rhino.Geometry as rg

def download_landsat_band_pointcloud(bbox_str, band_id, size=1000, agg=1, time_str=None):
    """
    Downloads a Landsat band as a Rhino PointCloud.
    
    Parameters:
    - bbox_str: string, "minx,miny,maxx,maxy" in EPSG:27700
    - band_id: int, e.g. 4 (Red), 5 (NIR), 10 (TIR)
    - size: int, raster resolution (e.g. 1000)
    - agg: int, pixel step for downsampling (e.g. 2)
    - time_str: optional ISO 8601 time filter (e.g. "2023-07-01T00:00:00,2023-07-31T23:59:59")
    
    Returns:
    - Rhino PointCloud object
    """
    # Parse bounding box
    minx, miny, maxx, maxy = map(float, bbox_str.split(","))
    bbox = [minx, miny, maxx, maxy]

    # Build the ESRI ImageServer exportImage URL
    print(f"📦 Requesting band {band_id} for bbox {bbox} at {size}x{size} resolution")
    url = (
        "https://landsat2.arcgis.com/arcgis/rest/services/Landsat8_Views/ImageServer/exportImage"
        f"?bbox={bbox[0]}%2C{bbox[1]}%2C{bbox[2]}%2C{bbox[3]}"
        f"&bboxSR=27700&size={size},{size}&imageSR=27700&format=tiff"
        f"&pixelType=S16&noData=&noDataInterpretation=esriNoDataMatchAny"
        f"&interpolation=RSP_BilinearInterpolation&bandIds={band_id}"
        f"&adjustAspectRatio=true"
        + (f"&time={time_str}" if time_str else "")
        + "&f=pjson"
    )

    # Request the exportImage JSON response
    r = requests.get(url)
    r.raise_for_status()
    tiff_url = r.json().get("href", None)
    if not tiff_url:
        raise Exception("❌ No TIFF URL returned from ESRI exportImage service")

    # Download the TIFF image to memory
    r_tiff = requests.get(tiff_url)
    r_tiff.raise_for_status()
    print("✅ TIFF successfully downloaded")

    # Convert TIFF to Rhino PointCloud
    with MemoryFile(r_tiff.content) as memfile:
        with memfile.open() as dataset:
            data = dataset.read(1)  # Read the first band
            transform = dataset.transform
            pc = rg.PointCloud()
            for row in range(0, data.shape[0], agg):
                for col in range(0, data.shape[1], agg):
                    z = float(data[row, col])
                    if math.isnan(z):
                        continue
                    x = transform.c + col * transform.a
                    y = transform.f + row * transform.e
                    pt = rg.Point3d(x, y, z)
                    pc.Add(pt)
    return pc

# =============================
# GRASSHOPPER EXECUTION BLOCK
# =============================

try:
    # Handle optional time input from Grasshopper
    time_str = Time if Time and Time.strip() else None

    if time_str:
        print(f"🕓 Time filter applied: {time_str}")
    else:
        print("🕓 No time filter applied — using most recent imagery.")

    # Run the function
    pc = download_landsat_band_pointcloud(BBox, Band, size=Pixels, agg=Agg, time_str=time_str)
    a = [pc]

except Exception as e:
    print(f"❌ Error: {str(e)}")
    a = None
# ---------- end landsat ----------
item = ListItem(List=panel_2, Index=subtraction, Wrap=True)
pcloud = PointCloud(landsat.a)
point_cloud = PointCloudAttributes(Cloud=pcloud)  # -> Cloud, Locations, Normals, Colours, Extra, Hidden
concat_2 = Concatenate(FragmentA="UC::LANDSAT::", FragmentB=item)
del = DelaunayMesh(Points=point_cloud.Locations, Plane=PlaneXY(0, 0, 0))
object = ModelObject(Geometry=del, Layer=concat_2)  # -> Object, Geometry, Name, Layer, Visibility, Display, Drafting, Render
c_bake = ContextBake(Content=object.Object)
