# Grasshopper definition V2_LANDSAT_EVI.gh (Grasshopper 1.0.8)

nir = Mesh(<mesh referenced from the Rhino model>)
red = Mesh(<mesh referenced from the Rhino model>)
blue = Mesh(<mesh referenced from the Rhino model>)
nir_2 = GetGeometry(
    nir,
    AnnotationTypeFilter=3966,
    AtLeast=1,
    AtMost=1,
    DeleteInput=False,
    Filter=32,
    Prompt="NIR band from the LANDSAT component",
    TreeAccess=False)
red_2 = GetGeometry(
    red,
    AnnotationTypeFilter=3966,
    AtLeast=1,
    AtMost=1,
    DeleteInput=False,
    Filter=32,
    Prompt="RED band from the LANDSAT component",
    TreeAccess=False)
blue_2 = GetGeometry(
    blue,
    AnnotationTypeFilter=3966,
    AtLeast=1,
    AtMost=1,
    DeleteInput=False,
    Filter=32,
    Prompt="BLUE band from the LANDSAT component",
    TreeAccess=False)
demesh = DeconstructMesh(Mesh=nir_2)  # -> Vertices, Faces, Colours, Normals
demesh_2 = DeconstructMesh(Mesh=red_2)  # -> Vertices, Faces, Colours, Normals
demesh_3 = DeconstructMesh(Mesh=blue_2)  # -> Vertices, Faces, Colours, Normals
pdecon = Deconstruct(Point=demesh.Vertices)  # -> XComponent, YComponent, ZComponent
pdecon_2 = Deconstruct(Point=demesh_2.Vertices)  # -> XComponent, YComponent, ZComponent
pdecon_3 = Deconstruct(Point=demesh_3.Vertices)  # -> XComponent, YComponent, ZComponent
expression = Expression(
    NIR=pdecon.ZComponent,
    RED=pdecon_2.ZComponent,
    BLUE=pdecon_3.ZComponent,
    Expression="2.5 * ((NIR-RED)/(NIR+(6*RED))-((7.5*BLUE)+1))")
panel = Panel("EVI (Enhanced Vegetation Index) is a satellite-derived vegetation index that improves on NDVI by reducing atmospheric and canopy background noise. It uses red, near-infrared (NIR), and blue bands to provide a more accurate measure of vegetation health in areas with dense canopy or high biomass. EVI is especially useful in tropical and forested regions where NDVI tends to saturate. Its formula includes correction factors for aerosol resistance and canopy background, making it more sensitive to changes in vegetation than NDVI")
pt = ConstructPoint(XCoordinate=pdecon.XComponent, YCoordinate=pdecon.YComponent, ZCoordinate=expression)
c_print = ContextPrint(Text=panel)
bnd = Bounds(Numbers=expression)
del = DelaunayMesh(Points=pt, Plane=PlaneXY(0, 0, 0))
dedomain = DeconstructDomain(Domain=bnd)  # -> Start, End
gradient = Gradient(
    LowerLimit=dedomain.Start,
    UpperLimit=dedomain.End,
    Parameter=expression,
    stops=[0: RGB(255, 255, 204), 0.333: RGB(194, 230, 153), 0.657: RGB(120, 198, 121), 1: RGB(35, 132, 67)])
mcol = MeshColours(Mesh=del, Colours=gradient)
object = ModelObject(Geometry=graft(mcol), Layer="UC::LANDSAT::ANALYSIS::EVI")  # -> Object, Geometry, Name, Layer, Visibility, Display, Drafting, Render
c_bake = ContextBake(Content=object.Object)
