# Grasshopper definition V2_LANDSAT_LSMS.gh (Grasshopper 1.0.8)

nir = GetGeometry(
    AnnotationTypeFilter=3966,
    AtLeast=1,
    AtMost=1,
    DeleteInput=False,
    Filter=32,
    Prompt="NIR band from the LANDSAT component",
    TreeAccess=False)
swir2 = GetGeometry(
    AnnotationTypeFilter=3966,
    AtLeast=1,
    AtMost=1,
    DeleteInput=False,
    Filter=32,
    Prompt="SWIR2 band from the LANDSAT component",
    TreeAccess=False)
demesh = DeconstructMesh(Mesh=nir)  # -> Vertices, Faces, Colours, Normals
demesh_2 = DeconstructMesh(Mesh=swir2)  # -> Vertices, Faces, Colours, Normals
pdecon = Deconstruct(Point=demesh.Vertices)  # -> XComponent, YComponent, ZComponent
pdecon_2 = Deconstruct(Point=demesh_2.Vertices)  # -> XComponent, YComponent, ZComponent
expression = Expression(NIR=pdecon.ZComponent, SWIR2=pdecon_2.ZComponent, Expression="SWIR2/NIR")
pt = ConstructPoint(XCoordinate=pdecon.XComponent, YCoordinate=pdecon.YComponent, ZCoordinate=expression)
bnd = Bounds(Numbers=expression)
del = DelaunayMesh(Points=pt, Plane=PlaneXY(0, 0, 0))
dedomain = DeconstructDomain(Domain=bnd)  # -> Start, End
panel = Panel("""LSMS (Land Surface Moisture Stress Index) is a remote sensing index designed to assess moisture stress in vegetation by combining information about vegetation health and surface temperature.

It is typically derived from NDVI and Land Surface Temperature (LST), similar to the Soil Moisture Index (SMI), but specifically focused on detecting vegetation stress due to water scarcity.

Concept:
Healthy, well-watered vegetation tends to have high NDVI and low LST.

Stressed vegetation (due to drought or insufficient water) shows low NDVI and high LST.

There are different methods for computing LSMS, but many rely on thermal–vegetation space analysis (e.g., trapezoid or triangle space using NDVI and LST).

Purpose: Identify areas where vegetation is under water stress.

Application:

Agricultural monitoring

Drought assessment

Ecosystem health evaluation

Water resource management""")
gradient = Gradient(
    LowerLimit=dedomain.Start,
    UpperLimit=dedomain.End,
    Parameter=expression,
    stops=[0: RGB(0, 104, 55), 0.5: RGB(255, 255, 153), 1: RGB(177, 89, 40)])
mcol = MeshColours(Mesh=del, Colours=gradient)
c_print = ContextPrint(Text=panel)
object = ModelObject(Geometry=graft(mcol), Layer="UC::LANDSAT::ANALYSIS::LSMS")  # -> Object, Geometry, Name, Layer, Visibility, Display, Drafting, Render
c_bake = ContextBake(Content=object.Object)
