# Grasshopper definition V2_LANDSAT_MNDNI.gh (Grasshopper 1.0.8)

swir1 = GetGeometry(
    AnnotationTypeFilter=3966,
    AtLeast=1,
    AtMost=1,
    DeleteInput=False,
    Filter=32,
    Prompt="SWIR1 band from the LANDSAT component",
    TreeAccess=False)
nir = GetGeometry(
    AnnotationTypeFilter=3966,
    AtLeast=1,
    AtMost=1,
    DeleteInput=False,
    Filter=32,
    Prompt="NIR band from the LANDSAT component",
    TreeAccess=False)
demesh = DeconstructMesh(Mesh=swir1)  # -> Vertices, Faces, Colours, Normals
demesh_2 = DeconstructMesh(Mesh=nir)  # -> Vertices, Faces, Colours, Normals
pdecon = Deconstruct(Point=demesh.Vertices)  # -> XComponent, YComponent, ZComponent
pdecon_2 = Deconstruct(Point=demesh_2.Vertices)  # -> XComponent, YComponent, ZComponent
expression = Expression(SWIR1=pdecon.ZComponent, NIR=pdecon_2.ZComponent, Expression="(NIR-SWIR1) / (NIR+SWIR1)")
panel = Panel("""MNDMI (Modified Normalized Difference Moisture Index) is a lesser-known but related remote sensing index designed to enhance the detection of moisture content, particularly in soil and vegetation, by modifying traditional moisture indices for improved sensitivity.

 

Purpose: Detect moisture levels in vegetation and soils, with a focus on improving accuracy under different environmental conditions.

Application: Drought monitoring, agricultural planning, and land degradation assessment""")
pt = ConstructPoint(XCoordinate=pdecon.XComponent, YCoordinate=pdecon.YComponent, ZCoordinate=expression)
bnd = Bounds(Numbers=expression)
del = DelaunayMesh(Points=pt, Plane=PlaneXY(0, 0, 0))
dedomain = DeconstructDomain(Domain=bnd)  # -> Start, End
gradient = Gradient(
    LowerLimit=dedomain.Start,
    UpperLimit=dedomain.End,
    Parameter=expression,
    stops=[0: RGB(215, 48, 39), 0.333: RGB(254, 224, 139), 0.657: RGB(145, 191, 219), 1: RGB(69, 117, 180)])
c_print = ContextPrint(Text=panel)
mcol = MeshColours(Mesh=del, Colours=gradient)
object = ModelObject(Geometry=graft(mcol), Layer="UC::LANDSAT::ANALYSIS::MNDMI")  # -> Object, Geometry, Name, Layer, Visibility, Display, Drafting, Render
c_bake = ContextBake(Content=object.Object)
