# Grasshopper definition V2_LANDSAT_MNDWI.gh (Grasshopper 1.0.8)

swir1 = Mesh(<mesh referenced from the Rhino model>)
swir1_2 = GetGeometry(
    swir1,
    AnnotationTypeFilter=3966,
    AtLeast=1,
    AtMost=1,
    DeleteInput=False,
    Filter=32,
    Prompt="SWIR1 band from the LANDSAT component",
    TreeAccess=False)
green = GetGeometry(
    AnnotationTypeFilter=3966,
    AtLeast=1,
    AtMost=1,
    DeleteInput=False,
    Filter=32,
    Prompt="GREEN band from the LANDSAT component",
    TreeAccess=False)
demesh = DeconstructMesh(Mesh=swir1_2)  # -> Vertices, Faces, Colours, Normals
demesh_2 = DeconstructMesh(Mesh=green)  # -> Vertices, Faces, Colours, Normals
pdecon = Deconstruct(Point=demesh.Vertices)  # -> XComponent, YComponent, ZComponent
pdecon_2 = Deconstruct(Point=demesh_2.Vertices)  # -> XComponent, YComponent, ZComponent
expression = Expression(SWIR1=pdecon.ZComponent, GREEN=pdecon_2.ZComponent, Expression="(GREEN-SWIR1) / (GREEN+SWIR1)")
pt = ConstructPoint(XCoordinate=pdecon.XComponent, YCoordinate=pdecon.YComponent, ZCoordinate=expression)
bnd = Bounds(Numbers=expression)
del = DelaunayMesh(Points=pt, Plane=PlaneXY(0, 0, 0))
dedomain = DeconstructDomain(Domain=bnd)  # -> Start, End
panel = Panel("""MNDWI (Modified Normalized Difference Water Index) is an enhanced version of NDWI that uses the green and shortwave infrared (SWIR) bands instead of NIR. This improves the detection of open water bodies, especially in urban or built-up areas where traditional NDWI may confuse water with built surfaces. Increases contrast between water and non-water features by suppressing noise from built-up land, vegetation, and soil. 

Application: Urban water mapping, flood detection, and surface water monitoring in complex landscapes.""")
gradient = Gradient(
    LowerLimit=dedomain.Start,
    UpperLimit=dedomain.End,
    Parameter=expression,
    stops=[0: RGB(216, 179, 101), 0.333: RGB(245, 245, 245), 0.657: RGB(116, 173, 209), 1: RGB(43, 131, 186)])
mcol = MeshColours(Mesh=del, Colours=gradient)
object = ModelObject(Geometry=graft(mcol), Layer="UC::LANDSAT::ANALYSIS::MNDWI")  # -> Object, Geometry, Name, Layer, Visibility, Display, Drafting, Render
c_print = ContextPrint(Text=panel)
c_bake = ContextBake(Content=object.Object)
