# Grasshopper definition V2_LANDSAT_NDBI.gh (Grasshopper 1.0.8)

swir2 = GetGeometry(
    AnnotationTypeFilter=3966,
    AtLeast=1,
    AtMost=1,
    DeleteInput=False,
    Filter=32,
    Prompt="SWIR2 band from the LANDSAT component",
    TreeAccess=False)
nir = GetGeometry(
    AnnotationTypeFilter=3966,
    AtLeast=1,
    AtMost=1,
    DeleteInput=False,
    Filter=32,
    Prompt="NIR band from the LANDSAT component",
    TreeAccess=False)
demesh = DeconstructMesh(Mesh=swir2)  # -> Vertices, Faces, Colours, Normals
demesh_2 = DeconstructMesh(Mesh=nir)  # -> Vertices, Faces, Colours, Normals
pdecon = Deconstruct(Point=demesh.Vertices)  # -> XComponent, YComponent, ZComponent
pdecon_2 = Deconstruct(Point=demesh_2.Vertices)  # -> XComponent, YComponent, ZComponent
expression = Expression(SWIR2=pdecon.ZComponent, NIR=pdecon_2.ZComponent, Expression="(SWIR2-NIR) / (SWIR2+NIR)")
pt = ConstructPoint(XCoordinate=pdecon.XComponent, YCoordinate=pdecon.YComponent, ZCoordinate=expression)
bnd = Bounds(Numbers=expression)
del = DelaunayMesh(Points=pt, Plane=PlaneXY(0, 0, 0))
dedomain = DeconstructDomain(Domain=bnd)  # -> Start, End
panel = Panel("""NDBI (Normalized Difference Built-up Index) is a remote sensing index used to identify built-up (urban) areas. It uses the Shortwave Infrared (SWIR) and Near-Infrared (NIR) bands to distinguish urban structures from vegetation and water.

​
 Higher NDBI values typically indicate urban or impervious surfaces (like buildings, roads).

Lower values correspond to vegetation or water.

Purpose: Detect and map urban development.

Application: Urban expansion analysis, land use classification, infrastructure monitoring""")
gradient = Gradient(
    LowerLimit=dedomain.Start,
    UpperLimit=dedomain.End,
    Parameter=expression,
    stops=[0: RGB(0, 104, 55), 0.333: RGB(255, 255, 191), 0.657: RGB(253, 141, 60), 1: RGB(189, 0, 38)])
c_print = ContextPrint(Text=panel)
mcol = MeshColours(Mesh=del, Colours=gradient)
object = ModelObject(Geometry=graft(mcol), Layer="UC::LANDSAT::ANALYSIS::NDBI")  # -> Object, Geometry, Name, Layer, Visibility, Display, Drafting, Render
c_bake = ContextBake(Content=object.Object)
