# Grasshopper definition V2_LANDSAT_NDRE.gh (Grasshopper 1.0.8)

red = GetGeometry(
    AnnotationTypeFilter=3966,
    AtLeast=1,
    AtMost=1,
    DeleteInput=False,
    Filter=32,
    Prompt="RED band from the LANDSAT component",
    TreeAccess=False)
nir = GetGeometry(
    AnnotationTypeFilter=3966,
    AtLeast=1,
    AtMost=1,
    DeleteInput=False,
    Filter=32,
    Prompt="NIR band from the LANDSAT component",
    TreeAccess=False)
demesh = DeconstructMesh(Mesh=nir)  # -> Vertices, Faces, Colours, Normals
demesh_2 = DeconstructMesh(Mesh=red)  # -> Vertices, Faces, Colours, Normals
pdecon = Deconstruct(Point=demesh.Vertices)  # -> XComponent, YComponent, ZComponent
pdecon_2 = Deconstruct(Point=demesh_2.Vertices)  # -> XComponent, YComponent, ZComponent
expression = Expression(NIR=pdecon.ZComponent, RED=pdecon_2.ZComponent, Expression="(NIR-RED) / (NIR+RED)")
pt = ConstructPoint(XCoordinate=pdecon.XComponent, YCoordinate=pdecon.YComponent, ZCoordinate=expression)
panel = Panel("""NDRE (Normalized Difference Red Edge Index) is a vegetation index that uses the red edge spectral band (typically around 705–740 nm) instead of the traditional red band used in NDVI. This makes NDRE more sensitive to chlorophyll content and stress in vegetation, especially in dense or mature canopies where NDVI tends to saturate.

 
NDRE is particularly useful for precision agriculture, as it provides better insight into plant health, nitrogen levels, and early stress detection than NDVI.""")
bnd = Bounds(Numbers=expression)
del = DelaunayMesh(Points=pt, Plane=PlaneXY(0, 0, 0))
dedomain = DeconstructDomain(Domain=bnd)  # -> Start, End
gradient = Gradient(
    LowerLimit=dedomain.Start,
    UpperLimit=dedomain.End,
    Parameter=expression,
    stops=[0: RGB(44, 123, 182), 0.333: RGB(255, 255, 191), 0.657: RGB(166, 217, 106), 1: RGB(26, 150, 65)])
c_print = ContextPrint(Text=panel)
mcol = MeshColours(Mesh=del, Colours=gradient)
object = ModelObject(Geometry=graft(mcol), Layer="UC::LANDSAT::ANALYSIS::NDRE")  # -> Object, Geometry, Name, Layer, Visibility, Display, Drafting, Render
c_bake = ContextBake(Content=object.Object)
