# Grasshopper definition V2_LANDSAT_NDSI.gh (Grasshopper 1.0.8)

swir1 = GetGeometry(
    AnnotationTypeFilter=3966,
    AtLeast=1,
    AtMost=1,
    DeleteInput=False,
    Filter=32,
    Prompt="SWIR1 band from the LANDSAT component",
    TreeAccess=False)
green = GetGeometry(
    AnnotationTypeFilter=3966,
    AtLeast=1,
    AtMost=1,
    DeleteInput=False,
    Filter=32,
    Prompt="GREEN band from the LANDSAT component",
    TreeAccess=False)
demesh = DeconstructMesh(Mesh=swir1)  # -> Vertices, Faces, Colours, Normals
demesh_2 = DeconstructMesh(Mesh=green)  # -> Vertices, Faces, Colours, Normals
pdecon = Deconstruct(Point=demesh.Vertices)  # -> XComponent, YComponent, ZComponent
pdecon_2 = Deconstruct(Point=demesh_2.Vertices)  # -> XComponent, YComponent, ZComponent
expression = Expression(SWIR1=pdecon.ZComponent, GREEN=pdecon_2.ZComponent, Expression="(GREEN-SWIR1) / (GREEN+SWIR1)")
pt = ConstructPoint(XCoordinate=pdecon.XComponent, YCoordinate=pdecon.YComponent, ZCoordinate=expression)
bnd = Bounds(Numbers=expression)
del = DelaunayMesh(Points=pt, Plane=PlaneXY(0, 0, 0))
dedomain = DeconstructDomain(Domain=bnd)  # -> Start, End
panel = Panel("""NDSI (Normalized Difference Snow Index) is a remote sensing index used to detect snow and ice cover in satellite imagery. It leverages the fact that snow reflects strongly in the green band but absorbs in the shortwave infrared (SWIR) band.

High NDSI values indicate snow or ice.

Low or negative values indicate vegetation, water, soil, or urban surfaces.

Purpose:
Identify and monitor snow cover while reducing confusion with clouds and other bright surfaces.

Applications:
Snow mapping and monitoring

Hydrological modeling

Climate studies

Water resource forecasting in mountainous regions""")
gradient = Gradient(
    LowerLimit=dedomain.Start,
    UpperLimit=dedomain.End,
    Parameter=expression,
    stops=[0: RGB(127, 59, 8), 0.333: RGB(253, 174, 97), 0.657: RGB(171, 217, 233), 1: RGB(255, 255, 255)])
c_print = ContextPrint(Text=panel)
mcol = MeshColours(Mesh=del, Colours=gradient)
object = ModelObject(Geometry=graft(mcol), Layer="UC::ANALYSIS::WATER::NDSI")  # -> Object, Geometry, Name, Layer, Visibility, Display, Drafting, Render
c_bake = ContextBake(Content=object.Object)
