# Grasshopper definition V2_LANDSAT_NDVI.gh (Grasshopper 1.0.8)

nir = Mesh(<mesh referenced from the Rhino model>)
red = Mesh(<mesh referenced from the Rhino model>)
nir_2 = GetGeometry(
    nir,
    AnnotationTypeFilter=3966,
    AtLeast=1,
    AtMost=1,
    DeleteInput=False,
    Filter=32,
    Prompt="NIR band from the LANDSAT component",
    TreeAccess=False)
red_2 = GetGeometry(
    red,
    AnnotationTypeFilter=3966,
    AtLeast=1,
    AtMost=1,
    DeleteInput=False,
    Filter=32,
    Prompt="RED band from the LANDSAT component",
    TreeAccess=False)
demesh = DeconstructMesh(Mesh=nir_2)  # -> Vertices, Faces, Colours, Normals
demesh_2 = DeconstructMesh(Mesh=red_2)  # -> Vertices, Faces, Colours, Normals
pdecon = Deconstruct(Point=demesh.Vertices)  # -> XComponent, YComponent, ZComponent
pdecon_2 = Deconstruct(Point=demesh_2.Vertices)  # -> XComponent, YComponent, ZComponent
expression = Expression(NIR=pdecon.ZComponent, RED=pdecon_2.ZComponent, Expression="(NIR - RED) / (NIR + RED)")
panel = Panel("NDVI (Normalized Difference Vegetation Index) is a remote sensing index used to measure vegetation health and density. It is calculated from satellite imagery using the difference between near-infrared (which vegetation strongly reflects) and red light (which vegetation absorbs). High NDVI values indicate healthy, dense vegetation and lower values represent barren land, water, or urban areas.")
pt = ConstructPoint(XCoordinate=pdecon.XComponent, YCoordinate=pdecon.YComponent, ZCoordinate=expression)
bnd = Bounds(Numbers=expression)
c_print = ContextPrint(Text=panel)
del = DelaunayMesh(Points=pt, Plane=PlaneXY(0, 0, 0))
dedomain = DeconstructDomain(Domain=bnd)  # -> Start, End
gradient = Gradient(
    LowerLimit=dedomain.Start,
    UpperLimit=dedomain.End,
    Parameter=expression,
    stops=[0: RGB(44, 123, 182), 0.333: RGB(255, 255, 191), 0.657: RGB(166, 217, 106), 1: RGB(26, 150, 65)])
mcol = MeshColours(Mesh=del, Colours=gradient)
object = ModelObject(Geometry=graft(mcol), Layer="UC::ANALYSIS::VEG::NDVI")  # -> Object, Geometry, Name, Layer, Visibility, Display, Drafting, Render
c_bake = ContextBake(Content=object.Object)
