# Grasshopper definition V2_LANDSAT_NDWI.gh (Grasshopper 1.0.8)

nir = GetGeometry(
    AnnotationTypeFilter=3966,
    AtLeast=1,
    AtMost=1,
    DeleteInput=False,
    Filter=32,
    Prompt="NIR band from the LANDSAT component",
    TreeAccess=False)
green = GetGeometry(
    AnnotationTypeFilter=3966,
    AtLeast=1,
    AtMost=1,
    DeleteInput=False,
    Filter=32,
    Prompt="GREEN band from the LANDSAT component",
    TreeAccess=False)
demesh = DeconstructMesh(Mesh=nir)  # -> Vertices, Faces, Colours, Normals
demesh_2 = DeconstructMesh(Mesh=green)  # -> Vertices, Faces, Colours, Normals
pdecon = Deconstruct(Point=demesh.Vertices)  # -> XComponent, YComponent, ZComponent
pdecon_2 = Deconstruct(Point=demesh_2.Vertices)  # -> XComponent, YComponent, ZComponent
expression = Expression(NIR=pdecon.ZComponent, GREEN=pdecon_2.ZComponent, Expression="(GREEN-NIR) / (GREEN+NIR)")
panel = Panel("NDWI (Normalized Difference Water Index – McFeeters, 1996) is a remote sensing index that uses green and NIR bands to enhance the detection of surface water bodies. By reducing the influence of vegetation and soil, it is effective for flood mapping, wetland delineation, and monitoring lakes and rivers.")
pt = ConstructPoint(XCoordinate=pdecon.XComponent, YCoordinate=pdecon.YComponent, ZCoordinate=expression)
bnd = Bounds(Numbers=expression)
del = DelaunayMesh(Points=pt, Plane=PlaneXY(0, 0, 0))
dedomain = DeconstructDomain(Domain=bnd)  # -> Start, End
c_print = ContextPrint(Text=panel)
gradient = Gradient(
    LowerLimit=dedomain.Start,
    UpperLimit=dedomain.End,
    Parameter=expression,
    stops=[0: RGB(166, 97, 26), 0.333: RGB(245, 245, 245), 0.657: RGB(31, 120, 180), 1: RGB(8, 29, 88)])
mcol = MeshColours(Mesh=del, Colours=gradient)
object = ModelObject(Geometry=graft(mcol), Layer="UC::ANALYSIS::WATER::NDWI")  # -> Object, Geometry, Name, Layer, Visibility, Display, Drafting, Render
c_bake = ContextBake(Content=object.Object)
