# Grasshopper definition V2_LANDSAT_SAVI.gh (Grasshopper 1.0.8)

nir = GetGeometry(
    AnnotationTypeFilter=3966,
    AtLeast=1,
    AtMost=1,
    DeleteInput=False,
    Filter=32,
    Prompt="NIR band from the LANDSAT component",
    TreeAccess=False)
red = GetGeometry(
    AnnotationTypeFilter=3966,
    AtLeast=1,
    AtMost=1,
    DeleteInput=False,
    Filter=32,
    Prompt="RED band from the LANDSAT component",
    TreeAccess=False)
demesh = DeconstructMesh(Mesh=nir)  # -> Vertices, Faces, Colours, Normals
demesh_2 = DeconstructMesh(Mesh=red)  # -> Vertices, Faces, Colours, Normals
pdecon = Deconstruct(Point=demesh.Vertices)  # -> XComponent, YComponent, ZComponent
pdecon_2 = Deconstruct(Point=demesh_2.Vertices)  # -> XComponent, YComponent, ZComponent
expression = Expression(NIR=pdecon.ZComponent, RED=pdecon_2.ZComponent, Expression="(((2*NIR)+1)-sqrt((2*NIR+1)² - (8*(NIR-RED))))/2")
panel = Panel("SAVI (Soil-Adjusted Vegetation Index) is a vegetation index designed to minimize the influence of soil brightness in areas with sparse vegetation. Like NDVI, it uses red and near-infrared (NIR) reflectance but introduces a correction factor (L) to account for soil reflectance. This makes SAVI particularly useful in arid or semi-arid regions where vegetation cover is low and the soil has a strong influence on reflectance values")
c_print = ContextPrint(Text=panel)
pt = ConstructPoint(XCoordinate=pdecon.XComponent, YCoordinate=pdecon.YComponent, ZCoordinate=expression)
bnd = Bounds(Numbers=expression)
del = DelaunayMesh(Points=pt, Plane=PlaneXY(0, 0, 0))
dedomain = DeconstructDomain(Domain=bnd)  # -> Start, End
gradient = Gradient(
    LowerLimit=dedomain.Start,
    UpperLimit=dedomain.End,
    Parameter=expression,
    stops=[0: RGB(255, 255, 229), 0.333: RGB(247, 252, 185), 0.657: RGB(166, 217, 106), 1: RGB(26, 150, 65)])
mcol = MeshColours(Mesh=del, Colours=gradient)
object = ModelObject(Geometry=graft(mcol), Layer="UC::LANDSAT::ANALYSIS::MSAVI")  # -> Object, Geometry, Name, Layer, Visibility, Display, Drafting, Render
c_bake = ContextBake(Content=object.Object)
