# Grasshopper definition V2_LANDSAT_SMI.gh (Grasshopper 1.0.8)

swir1 = GetGeometry(
    AnnotationTypeFilter=3966,
    AtLeast=1,
    AtMost=1,
    DeleteInput=False,
    Filter=32,
    Prompt="SWIR1 band from the LANDSAT component",
    TreeAccess=False)
swir2 = GetGeometry(
    AnnotationTypeFilter=3966,
    AtLeast=1,
    AtMost=1,
    DeleteInput=False,
    Filter=32,
    Prompt="SWIR2 band from the LANDSAT component",
    TreeAccess=False)
demesh = DeconstructMesh(Mesh=swir1)  # -> Vertices, Faces, Colours, Normals
demesh_2 = DeconstructMesh(Mesh=swir2)  # -> Vertices, Faces, Colours, Normals
pdecon = Deconstruct(Point=demesh.Vertices)  # -> XComponent, YComponent, ZComponent
pdecon_2 = Deconstruct(Point=demesh_2.Vertices)  # -> XComponent, YComponent, ZComponent
expression = Expression(SWIR1=pdecon.ZComponent, SWIR2=pdecon_2.ZComponent, Expression="(SWIR2-SWIR1) / (SWIR2+SWIR1)")
pt = ConstructPoint(XCoordinate=pdecon.XComponent, YCoordinate=pdecon.YComponent, ZCoordinate=expression)
bnd = Bounds(Numbers=expression)
panel = Panel("""SMI (Soil Moisture Index) is a remote sensing index used to estimate the relative moisture content of soil. It typically combines thermal infrared (TIR) and vegetation indices (like NDVI) to infer soil wetness, especially in exposed or sparsely vegetated areas.

Purpose: Estimate surface soil moisture where in-situ data is limited.

Application: Drought monitoring, irrigation management, and hydrological modeling.""")
del = DelaunayMesh(Points=pt, Plane=PlaneXY(0, 0, 0))
dedomain = DeconstructDomain(Domain=bnd)  # -> Start, End
gradient = Gradient(
    LowerLimit=dedomain.Start,
    UpperLimit=dedomain.End,
    Parameter=expression,
    stops=[0: RGB(0, 104, 55), 0.5: RGB(255, 255, 153), 1: RGB(177, 89, 40)])
c_print = ContextPrint(Text=panel)
mcol = MeshColours(Mesh=del, Colours=gradient)
object = ModelObject(Geometry=graft(mcol), Layer="UC::LANDSAT::ANALYSIS::SMI")  # -> Object, Geometry, Name, Layer, Visibility, Display, Drafting, Render
c_bake = ContextBake(Content=object.Object)
