# Grasshopper definition V2_LANDSAT_UTCI.gh (Grasshopper 1.0.8)
# plug-ins: Pufferfish

red = Mesh(<mesh referenced from the Rhino model>)
nir = Mesh(<mesh referenced from the Rhino model>)
tir = Mesh(<mesh referenced from the Rhino model>)
red_2 = GetGeometry(
    red,
    AnnotationTypeFilter=3966,
    AtLeast=1,
    AtMost=1,
    DeleteInput=False,
    Filter=32,
    Prompt="RED band from the LANDSAT component",
    TreeAccess=False)
nir_2 = GetGeometry(
    nir,
    AnnotationTypeFilter=3966,
    AtLeast=1,
    AtMost=1,
    DeleteInput=False,
    Filter=32,
    Prompt="NIR band from the LANDSAT component",
    TreeAccess=False)
tir_2 = GetGeometry(
    tir,
    AnnotationTypeFilter=3966,
    AtLeast=1,
    AtMost=1,
    DeleteInput=False,
    Filter=32,
    Prompt="TIR band from the LANDSAT component",
    TreeAccess=False)
demesh = DeconstructMesh(Mesh=red_2)  # -> Vertices, Faces, Colours, Normals
demesh_2 = DeconstructMesh(Mesh=nir_2)  # -> Vertices, Faces, Colours, Normals
demesh_3 = DeconstructMesh(Mesh=tir_2)  # -> Vertices, Faces, Colours, Normals
pdecon = Deconstruct(Point=demesh.Vertices)  # -> XComponent, YComponent, ZComponent
pdecon_2 = Deconstruct(Point=demesh_2.Vertices)  # -> XComponent, YComponent, ZComponent
pdecon_3 = Deconstruct(Point=demesh_3.Vertices)  # -> XComponent, YComponent, ZComponent
expression = Expression(M="0.0003342", Q=pdecon_3.ZComponent, A="0.1", Expression="(M*Q)+A")
expression_2 = Expression(NIR=pdecon_2.ZComponent, RED=pdecon.ZComponent, Expression="(NIR - RED) / (NIR + RED + 10^-6)")
lλ = Number(expression)
expression_3 = Expression(K2="1321.0789", K1="774.8853", L=lλ, Expression="K2/ln((K1/L+(10^-6))+1)")
ndvi = Number(expression_2)
expression_4 = Expression(NDVI=ndvi, Expression="(0.004*NDVI)+0.986")
bt = Number(expression_3)
subtraction = Subtraction(A=bt, B="273")
lst__raw = Number(subtraction)
ε = Number(expression_4)
relative_humidity = GetNumber(
    "50",
    AtLeast=1,
    AtMost=1,
    Maximum=1.797693135e+308,
    Minimum=-1.797693135e+308,
    Prompt="Relative Humidity Value can be extracted from EPW data in Ladybug (Default Value is 50%)",
    TreeAccess=False)
wind_spped = GetNumber(
    "1.5",
    AtLeast=1,
    AtMost=1,
    Maximum=1.797693135e+308,
    Minimum=-1.797693135e+308,
    Prompt="Wind Speed Value can be extracted from EPW data in Ladybug (Default Value is 1.5 m/s)",
    TreeAccess=False)
division = Division(A=subtraction, B=ε)
lst = Number(division)
expression_5 = Expression(LST=lst, RH=relative_humidity, WS=wind_spped, Expression="LST - 0.7 * WS + 0.002 * RH * (40 - LST)")
utci = Number(expression_5)
bnd = Bounds(Numbers=utci)
pt = ConstructPoint(XCoordinate=pdecon.XComponent, YCoordinate=pdecon.YComponent, ZCoordinate=utci)
dedomain = DeconstructDomain(Domain=bnd)  # -> Start, End
subtraction_2 = Subtraction(A=dedomain.Start, B="1")
addition = Addition(A=dedomain.End, B="1")
del = DelaunayMesh(Points=pt, Plane=PlaneXY(0, 0, 0))
gradient = Gradient(
    LowerLimit=addition,
    UpperLimit=subtraction_2,
    Parameter=utci,
    stops=[0: RGB(234, 38, 0), 0.25: RGB(234, 126, 0), 0.5: RGB(254, 244, 84), 0.75: RGB(173, 203, 249), 1: RGB(75, 107, 169)])
subtraction_3 = Subtraction(A=addition, B=subtraction_2)
round = Round(Number=subtraction_2)  # -> Nearest, Floor, Ceiling
round_2 = Round(Number=subtraction_3)  # -> Nearest, Floor, Ceiling
division_2 = Division(A=round_2.Nearest, B="0.5")
series = Series(Start=round.Nearest, Step="0.5", Count=division_2)
gradient_2 = Gradient(
    LowerLimit=addition,
    UpperLimit=subtraction_2,
    Parameter=series,
    stops=[0: RGB(234, 38, 0), 0.25: RGB(234, 126, 0), 0.5: RGB(254, 244, 84), 0.75: RGB(173, 203, 249), 1: RGB(75, 107, 169)])
concat = Concatenate(FragmentA=series, FragmentB=" °C")
brec = BoundingRectangle(Geometry=red_2, Plane=PlaneXY(0, 0, 0), Axis=0, Slide=0, Union=True)  # -> Bounding, DimensionX, DimensionY
debrep = DeconstructBrep(Brep=brec.Bounding)  # -> Faces, Edges, Vertices
lng = ListLength(List=concat)
item = ListItem(List=debrep.Vertices, Index=0, Wrap=True)
item_2 = ListItem(List=debrep.Vertices, Index=1, Wrap=True)
dist = Distance(PointA=item, PointB=item_2)
division_3 = Division(A=dist, B=lng)
addition_2 = Addition(A=dist, B="50")
X = UnitX(Factor=addition_2)
division_4 = Division(A=division_3, B="6")
move = Move(Geometry=item, Motion=X)  # -> Geometry, Transform
project = Project(Geometry=move.Geometry, Plane=PlaneXY(0, 0, 0))  # -> Geometry, Transform
sqgrid = Square(Plane=project.Geometry, Size=division_3, ExtentX="1", ExtentY=lng)  # -> Cells, Points
as_text = AnnotationTextSettings(Font="Replica Std", TextHeight=division_4, Mask="0", HorizontalAlignment="1", VerticalAlignment="3")  # -> TextSettings, Font, TextHeight, TextGap, Mask, MaskColour, MaskMargins, MaskFrame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
annotation_style = AnnotationStyle(AnnotationStyle="UC", TextSettings=as_text.TextSettings)  # -> AnnotationStyle, Name, ModelScale, TextSettings, DimensionSettings, ArrowSettings, UnitsSettings, LeaderSettings, ToleranceSettings
col = Colour(graft(gradient_2))
area = Area(Geometry=sqgrid.Cells)  # -> Area, Centroid
cpoly = ControlPolygon(Curve=sqgrid.Cells)  # -> Polygon, Points
shift = ShiftList(List=cpoly.Points, Shift=1, Wrap=False)
text_entity = TextEntity(Plane=area.Centroid, Text=concat, Style=annotation_style.AnnotationStyle)  # -> TextEntity, Plane, Text, Style
mcol = MeshColours(Mesh=del, Colours=gradient)
replace = ReplaceItems(List=shift, Item=col, Indices=[0, 1, 2, 3], Wrap=False)
conmesh = ConstructMesh(Vertices=shift, Faces={A=0, B=1, C=2, D=3}, Colours=replace)
mjoin = MeshJoin(Meshes=flatten(conmesh))
merge = Merge(Data1=mcol, Data2=mjoin, Data3=text_entity.TextEntity)
concat_2 = Concatenate(FragmentA="UC::LANDSAT::ANALYSIS::", FragmentB="UTCI")
object = ModelObject(Geometry=merge, Layer=concat_2)  # -> Object, Geometry, Name, Layer, Visibility, Display, Drafting, Render
c_bake = ContextBake(Content=object.Object)
