# Grasshopper definition V2_OSM_BLD_COMPONENT.gh (Grasshopper 1.0.8)
# plug-ins: treesloth01

panel = Panel("Include non classified buildings?; This will consider non-class buildings as residential and include these in the population estimation")
epsg_in = GetInteger(
    "4326",
    AtLeast=1,
    AtMost=1,
    Maximum=2147483647,
    Minimum=-2147483648,
    Prompt="EPSG code from your Lat and Lon coordinates",
    TreeAccess=False)
latitude = GetNumber(
    "51.54239",
    AtLeast=1,
    AtMost=1,
    Maximum=1.797693135e+308,
    Minimum=-1.797693135e+308,
    Prompt="Latitude Coordinate in your defined EPSG_in step",
    TreeAccess=False)
longitude = GetNumber(
    "-0.05193",
    AtLeast=1,
    AtMost=1,
    Maximum=1.797693135e+308,
    Minimum=-1.797693135e+308,
    Prompt="Longitude Coordinate in your defined EPSG_in step",
    TreeAccess=False)
epsg_out = GetInteger(
    "27700",
    AtLeast=1,
    AtMost=1,
    Maximum=2147483647,
    Minimum=-2147483648,
    Prompt="EPSG code to re-project geometry to",
    TreeAccess=False)
radius = GetInteger("500", AtLeast=1, AtMost=1, Maximum=2147483647, Minimum=-2147483648, Prompt="Analysis radious", TreeAccess=False)
panel_2 = Panel("""Yes
No""")
rtrig = RightTrigonometry(PLength=radius, QLength=radius)  # -> Alpha, Beta, PLength, QLength, RLength
py3 = Python3Script(options=panel_2, TXT=panel)  # -> out, b; inputs options: list of String, TXT: String
# ---------- py3: Python ----------
import Rhino
import scriptcontext as sc
import rhinoscriptsyntax as rs


def select_option():
    # Set up the command-line options
    go = Rhino.Input.Custom.GetOption()
    go.SetCommandPrompt(TXT)

    # Add each category as an option
    for cat in options:
        go.AddOption(cat)

    # Wait for user input
    while True:
        result = go.Get()
        if result == Rhino.Input.GetResult.Option:
            selected = go.Option().EnglishName
            print("You selected:", selected)
            return selected
        elif result == Rhino.Input.GetResult.Cancel:
            print("Selection cancelled.")
            return None


#############################################

category = select_option()


b = category
# ---------- end py3 ----------
osm_bld_data = Python3Script(EPSG_in=epsg_in, lat=latitude, lon=longitude, EPSG_out=epsg_out, rad=rtrig.RLength)  # -> out, Geo, Attr; inputs lat: String, rad: Int32
# ---------- osm_bld_data: Python ----------
#! python 3
#r: shapely, pyproj

import requests
from shapely.geometry import Polygon, MultiPolygon, shape
from pyproj import Transformer
from Rhino.Geometry import Point3d, Polyline
from Grasshopper import DataTree
from Grasshopper.Kernel.Data import GH_Path

def lonlat_to_xy(coords, transformer):
    return [transformer.transform(x, y) for x, y in coords]

def polygon_to_polyline(polygon, transformer):
    coords = list(polygon.exterior.coords)
    xy = lonlat_to_xy(coords, transformer)
    points = [Point3d(x, y, 0) for x, y in xy]
    return Polyline(points)

try:
    # Grasshopper inputs
    radius = float(rad)
    epsg_from = f"EPSG:{int(EPSG_in)}"
    epsg_to = f"EPSG:{int(EPSG_out)}"
    transformer = Transformer.from_crs(epsg_from, epsg_to, always_xy=True)

    print(f"📡 Querying buildings within {radius}m around lat: {lat}, lon: {lon}")

    # Overpass query for buildings only (way + relation)
    query = f"""
    [out:json][timeout:25];
    (
        way["building"](around:{radius},{lat},{lon});
        relation["building"](around:{radius},{lat},{lon});
    );
    out body;
    >;
    out skel qt;
    """

    # API call
    r = requests.post("https://overpass-api.de/api/interpreter", data={"data": query})
    data = r.json()

    # Build geometry dictionaries
    nodes = {el["id"]: (el["lon"], el["lat"]) for el in data["elements"] if el["type"] == "node"}
    ways = {el["id"]: el for el in data["elements"] if el["type"] == "way"}

    Geo = []
    Attr = DataTree[object]()
    count = 0

    for el in data["elements"]:
        if el["type"] not in ("way", "relation"):
            continue
        if "tags" not in el or "building" not in el["tags"]:
            continue

        geometry = None

        # Handle closed ways (Polygon)
        if el["type"] == "way":
            coords = [nodes[nid] for nid in el["nodes"] if nid in nodes]
            if len(coords) >= 4 and coords[0] == coords[-1]:
                geometry = Polygon(coords)

        # Handle relations (MultiPolygon)
        elif el["type"] == "relation":
            outers = []
            for m in el.get("members", []):
                if m["type"] == "way" and m.get("role") == "outer" and m["ref"] in ways:
                    w = ways[m["ref"]]
                    coords = [nodes[nid] for nid in w["nodes"] if nid in nodes]
                    if len(coords) >= 4 and coords[0] == coords[-1]:
                        outers.append(Polygon(coords))
            if outers:
                geometry = MultiPolygon(outers)

        # Skip non-polygons
        if geometry is None or not isinstance(geometry, (Polygon, MultiPolygon)):
            continue

        # Convert to polyline(s)
        if isinstance(geometry, Polygon):
            Geo.append(polygon_to_polyline(geometry, transformer))
            path = GH_Path(count)
            for k, v in el["tags"].items():
                Attr.Add(f"{k}: {v}", path)
            count += 1

        elif isinstance(geometry, MultiPolygon):
            for poly in geometry.geoms:
                Geo.append(polygon_to_polyline(poly, transformer))
                path = GH_Path(count)
                for k, v in el["tags"].items():
                    Attr.Add(f"{k}: {v}", path)
                count += 1

    print(f"✅ {count} closed building polygons extracted.")

except Exception as e:
    print(f"❌ Error: {e}")
    Geo = []
    Attr = None
# ---------- end osm_bld_data ----------
tmatch = MatchText(Text=py3.b, RegEx="Yes", Case=True)
panel_3 = Panel(py3.b)
bbox = Python3Script(EPSG_in=epsg_in, Latitude=latitude, Longitude=longitude, rad=radius, EPSG_out=epsg_out)  # -> out, Geo, BBox; inputs rad: Int32
# ---------- bbox: Python ----------
# r: pyproj
#! python 3

import Rhino.Geometry as rg
from pyproj import CRS, Transformer
import traceback
import math

try:
    # --------------------------------------------
    # Inputs from Grasshopper
    lat = float(Latitude)
    lon = float(Longitude)
    epsg_in = f"EPSG:{int(EPSG_in)}"
    epsg_out = f"EPSG:{int(EPSG_out)}"
    half_size = float(rad)

    # Check if output CRS is geographic (degrees) or projected (meters)
    crs_out = CRS.from_user_input(epsg_out)
    is_geographic = crs_out.is_geographic

    if is_geographic:
        # --------------------------------------------
        # Convert rad from meters to degrees
        lat_buffer = half_size / 111000.0
        lon_buffer = half_size / (111000.0 * math.cos(math.radians(lat)))

        x_lower = lon - lon_buffer
        x_upper = lon + lon_buffer
        y_lower = lat - lat_buffer
        y_upper = lat + lat_buffer

        # Polyline in degrees
        corners = [
            rg.Point3d(x_lower, y_lower, 0),
            rg.Point3d(x_upper, y_lower, 0),
            rg.Point3d(x_upper, y_upper, 0),
            rg.Point3d(x_lower, y_upper, 0),
            rg.Point3d(x_lower, y_lower, 0)
        ]

    else:
        # --------------------------------------------
        # Transform to projected CRS
        transformer = Transformer.from_crs(epsg_in, epsg_out, always_xy=True)
        x_cen, y_cen = transformer.transform(lon, lat)

        x_lower = x_cen - half_size
        x_upper = x_cen + half_size
        y_lower = y_cen - half_size
        y_upper = y_cen + half_size

        # Polyline in projected coords
        corners = [
            rg.Point3d(x_lower, y_lower, 0),
            rg.Point3d(x_upper, y_lower, 0),
            rg.Point3d(x_upper, y_upper, 0),
            rg.Point3d(x_lower, y_upper, 0),
            rg.Point3d(x_lower, y_lower, 0)
        ]

    # --------------------------------------------
    # Create Rhino curve
    polyline = rg.Polyline(corners).ToNurbsCurve()

    # Outputs
    Geo = polyline
    BBox = f"{x_lower},{y_lower},{x_upper},{y_upper}"

except Exception as e:
    Geo = None
    BBox = f"❌ Error: {str(e)}"
# ---------- end bbox ----------
rep = ReplaceText(Text=osm_bld_data.Attr, Find=": ", Replace="-", RecursiveReplace=False)
geo = Geometry(osm_bld_data.Geo)
split = TextSplit(Text=rep, Separators="-")
panel_4 = Panel(bbox.BBox)
item = ListItem(List=split, Index=0, Wrap=True)
item_2 = ListItem(List=split, Index=1, Wrap=True)
pshift = ShiftPaths(Data=item, Offset=-1)
pshift_2 = ShiftPaths(Data=item_2, Offset=-1)
tmatch_2 = MatchText(Text=pshift, RegEx="building", Case=True)
panel_5 = Panel("""apartments
barracks
bungalow
cabin
detached
annexe
dormitory
farm
ger
hotel
house
houseboat
residential
semidetached_house
static_caravan
stilt_house
terrace
tree_house
trullo""")
dispatch = Dispatch(List=pshift_2, DispatchPattern=tmatch_2)  # -> ListA, ListB
item_3 = ListItem(List=dispatch.ListA, Index="0", Wrap=True)  # -> flatten(Item)
nomis_api_key = GetString(
    "0x91af78e1b17c308200138f77c6bad391e43fab7a",
    AtLeast=1,
    AtMost=1,
    Prompt="You can get your FREE API Key in here: https://www.nomisweb.co.uk/login/login.asp?target=/api/v01/help&params=",
    TreeAccess=False)
ins = InsertItems(List=panel_5, Item="yes", Indices="-1", Wrap=True)
filter = StreamFilter(Gate=tmatch, Stream0=panel_5, Stream1=ins)
population_data = Python3Script(BBox=panel_4, API_Key=nomis_api_key)  # -> out, Geo, Attr, NomisRaw
# ---------- population_data: Python ----------
#! python 3
#r: requests, shapely

import requests
import json
import Rhino.Geometry as rg
import Grasshopper
import Grasshopper.Kernel as gh
from shapely.geometry import shape, Polygon, MultiPolygon

def parse_bbox(bbox_str):
    return list(map(float, bbox_str.split(",")))

def get_output_areas_from_bbox(bbox, crs):
    print("🌐 Querying Output Areas...")
    url = "https://services1.arcgis.com/ESMARspQHYMw9BZ9/arcgis/rest/services/Output_Areas_Dec_2011_Boundaries_EW_BFC_2022/FeatureServer/0/query"
    params = {
        "where": "1=1",
        "outFields": "*",
        "geometry": ",".join(map(str, bbox)),
        "geometryType": "esriGeometryEnvelope",
        "inSR": crs,
        "spatialRel": "esriSpatialRelIntersects",
        "outSR": crs,
        "f": "geojson"
    }
    res = requests.get(url, params=params)
    res.raise_for_status()
    data = res.json()
    features = data.get("features", [])

    geometries = []
    attributes = []

    for feat in features:
        geom = shape(feat["geometry"])
        attr = feat["properties"]
        geometries.append(geom)
        attributes.append(attr)
    
    return geometries, attributes

def query_population_by_oa(oa_codes, api_key):
    print("📊 Querying NOMIS for population...")
    url = "https://www.nomisweb.co.uk/api/v01/dataset/NM_2010_1.data.json"
    params = {
        "geography": ",".join(oa_codes),
        "gender": "0",
        "c_age": "200",
        "measures": "20100",
        "date": "latest",
        "uid": api_key
    }
    res = requests.get(url, params=params)
    res.raise_for_status()
    data = res.json()
    print("DEBUG NOMIS response keys:", data.keys())
    return data

def extract_population_data(nomis_data):
    values = {}
    for obs in nomis_data.get("obs", []):
        geo = obs.get("geography", {}).get("value") or obs.get("GEOGRAPHY_CODE")
        pop = obs.get("obs_value", {}).get("value") or obs.get("OBS_VALUE")
        if geo:
            values[geo] = pop
    return values

def to_rhino_geometry(geom):
    if isinstance(geom, Polygon):
        pts = [rg.Point3d(x, y, 0) for x, y in geom.exterior.coords]
        return rg.Polyline(pts).ToNurbsCurve()
    elif isinstance(geom, MultiPolygon):
        return [rg.Polyline([rg.Point3d(x, y, 0) for x, y in poly.exterior.coords]).ToNurbsCurve() for poly in geom.geoms]
    return None

def attrs_to_tree(attributes):
    tree = Grasshopper.DataTree[str]()
    for i, attr in enumerate(attributes):
        path = gh.Data.GH_Path(i)
        for k, v in attr.items():
            tree.Add(f"{k}: {v}", path)
    return tree

# === MAIN ===
try:
    print("🚀 Running script")
    bbox = parse_bbox(BBox)
    geometries, attributes = get_output_areas_from_bbox(bbox, 27700)
    oa_codes = [attr.get("OA11CD") for attr in attributes if "OA11CD" in attr]

    nomis_data = query_population_by_oa(oa_codes, API_Key)
    pop_data = extract_population_data(nomis_data)

    for attr in attributes:
        code = attr.get("OA11CD")
        attr["Population"] = pop_data.get(code, "NA")

    rhino_geoms = []
    for geom in geometries:
        g = to_rhino_geometry(geom)
        if isinstance(g, list):
            rhino_geoms.extend(g)
        elif g:
            rhino_geoms.append(g)

    Geo = rhino_geoms
    Attr = attrs_to_tree(attributes)
    NomisRaw = json.dumps(nomis_data, indent=2)

except Exception as e:
    import traceback
    tree = Grasshopper.DataTree[str]()
    tree.Add(str(e), gh.Data.GH_Path(0))
    tree.Add(traceback.format_exc(), gh.Data.GH_Path(1))
    Geo = []
    Attr = tree
    NomisRaw = "{}"
# ---------- end population_data ----------
tmatch_3 = MatchText(Text=item_3, RegEx=graft(filter), Case="False")
split_2 = TextSplit(Text=population_data.Attr, Separators=":")
flip = FlipMatrix(Data=tmatch_3)
geo_2 = Geometry(population_data.Geo)
ma = MassAddition(Input=flip)  # -> Result, PartialResults
item_4 = ListItem(List=split_2, Index=0, Wrap=True)
item_5 = ListItem(List=split_2, Index=1, Wrap=True)
rint = RegionIntersection(CurvesA=geo_2, CurvesB=bbox.Geo)
larger = LargerThan(FirstNumber=ma.Result, SecondNumber="0")  # -> LargerThan, OrEqualTo
pshift_3 = ShiftPaths(Data=item_4, Offset=-1)
pshift_4 = ShiftPaths(Data=item_5, Offset=-1)
area = Area(Geometry=geo_2)  # -> Area, Centroid
area_2 = Area(Geometry=rint)  # -> Area, Centroid
tmatch_4 = MatchText(Text=pshift_3, RegEx="Population", Case=True)
division = Division(A=area_2.Area, B=area.Area)
dispatch_2 = Dispatch(List=pshift_4, DispatchPattern=tmatch_4)  # -> ListA, ListB
lidar_data = Python3Script(BBox=panel_4, mode="DTM", resolution="1", aggregate="4")  # -> out, Pointcloud, Attr, Data; inputs BBox: String, mode: String, aggregate: Int32
# ---------- lidar_data: Python ----------
#! python 3
# r: requests, rasterio

import requests
from rasterio.io import MemoryFile
import Rhino.Geometry as rg
import math
import traceback

try:
    # Parse inputs
    minx, miny, maxx, maxy = map(float, BBox.split(","))
    res = float(resolution)
    agg = int(aggregate)
    mode = mode.strip().upper()

    print("📦 Mode:", mode)

    # Choose WCS URL and Coverage ID
    if mode == "DSM":
        wcs_url = "https://environment.data.gov.uk/geoservices/datasets/9ba4d5ac-d596-445a-9056-dae3ddec0178/wcs"
        coverage_id = "9ba4d5ac-d596-445a-9056-dae3ddec0178__Lidar_Composite_Elevation_LZ_DSM_1m"
    elif mode == "VOM":
        wcs_url = "https://environment.data.gov.uk/spatialdata/vegetation-object-model/wcs"
        coverage_id = "ecae3bef-1e1d-4051-887b-9dc613c928ec__Vegetation_Object_Model_Elevation_2022"
    else:
        wcs_url = "https://environment.data.gov.uk/geoservices/datasets/13787b9a-26a4-4775-8523-806d13af58fc/wcs"
        coverage_id = "13787b9a-26a4-4775-8523-806d13af58fc__Lidar_Composite_Elevation_DTM_1m"

    width = int((maxx - minx) / res)
    height = int((maxy - miny) / res)

    print(f"📏 Width: {width}, Height: {height}")

    # Build WCS GetCoverage request
    wcs_params = {
        "service": "WCS",
        "version": "2.0.1",
        "request": "GetCoverage",
        "coverageId": coverage_id,
        "format": "image/tiff",
        "subset": [
            f"E({minx},{maxx})",
            f"N({miny},{maxy})"
        ],
        "crs": "http://www.opengis.net/def/crs/EPSG/0/27700",
        "width": width,
        "height": height
    }

    print("🌐 Sending WCS request...")

    response = requests.get(wcs_url, params=wcs_params)
    response.raise_for_status()
    print("✅ WCS request successful")

    with MemoryFile(response.content) as memfile:
        with memfile.open() as dataset:
            data = dataset.read(1)
            transform = dataset.transform
            profile = dataset.profile

            print("📥 Raster loaded")
            print("🔢 Shape:", data.shape)
            print("🧭 Transform:", transform)

            pc = rg.PointCloud()
            z_min = float('inf')
            z_max = float('-inf')
            count = 0

            for row in range(0, data.shape[0], agg):
                for col in range(0, data.shape[1], agg):
                    z = float(data[row, col])
                    if math.isnan(z): continue

                    x = transform.c + col * transform.a
                    y = transform.f + row * transform.e
                    pc.Add(rg.Point3d(x, y, z))
                    z_min = min(z_min, z)
                    z_max = max(z_max, z)
                    count += 1

            # ✅ Outputs
            Pointcloud = [pc]
            Attr = [f"{k}: {v}" for k, v in {
                "dataset": mode,
                "shape": data.shape,
                "bounds": dataset.bounds,
                "min": z_min,
                "max": z_max,
                "resolution": res,
                "aggregate": agg,
                "point_count": count,
                "EPSG": str(profile.get("EPSG", "27700"))
            }.items()]
            Data = data

except Exception as e:
    print("❌ ERROR:")
    print(traceback.format_exc())
    Pointcloud = None
    Attr = [f"❌ Error: {str(e)}", traceback.format_exc()]
    Data = None
# ---------- end lidar_data ----------
lidar_data_2 = Python3Script(BBox=panel_4, mode="DSM", resolution="1", aggregate="4")  # -> out, Pointcloud, Attr, Data; inputs BBox: String, mode: String, aggregate: Int32; same code as lidar_data
multiplication = Multiplication(A=dispatch_2.ListA, B=graft(division))
round = Round(Number=multiplication)  # -> Nearest, Floor, Ceiling
pcloud = PointCloud(lidar_data.Pointcloud)
data = Data(lidar_data.Attr)
data_2 = Data(lidar_data.Data)
pcloud_2 = PointCloud(lidar_data_2.Pointcloud)
data_3 = Data(lidar_data_2.Attr)
data_4 = Data(lidar_data_2.Data)
point_cloud = PointCloudAttributes(Cloud=pcloud)  # -> Cloud, Locations, Normals, Colours, Extra, Hidden
point_cloud_2 = PointCloudAttributes(Cloud=pcloud_2)  # -> Cloud, Locations, Normals, Colours, Extra, Hidden
del = DelaunayMesh(Points=point_cloud.Locations, Plane=PlaneXY(0, 0, 0))
del_2 = DelaunayMesh(Points=point_cloud_2.Locations, Plane=PlaneXY(0, 0, 0))
demesh = DeconstructMesh(Mesh=del_2)  # -> Vertices, Faces, Colours, Normals
demesh_2 = DeconstructMesh(Mesh=del)  # -> Vertices, Faces, Colours, Normals
point_cloud_3 = PointCloudAttributes(Locations=demesh.Vertices)  # -> Cloud, Locations, Normals, Colours, Extra, Hidden
point_cloud_4 = PointCloudAttributes(Locations=demesh_2.Vertices)  # -> Cloud, Locations, Normals, Colours, Extra, Hidden
area_3 = Area(Geometry=geo)  # -> Area, Centroid
py3_2 = Python3Script(DSM=point_cloud_3.Cloud, DTM=point_cloud_4.Cloud, Buildings=geo)  # -> out, BuildingHeights; inputs DSM: PointCloud, DTM: PointCloud, Buildings: list of Polyline
# ---------- py3_2: Python ----------
#! python 3
import math
import statistics
from Rhino.Geometry import Point3d

# ================================
# PARAMETERS
# ================================
resolution = 0.5      # Raster cell size (m)
percentile = 95       # Percentile for building height extraction

# ================================
# HELPER FUNCTIONS
# ================================
def compute_bounds(points):
    """Compute bounding box of the point cloud."""
    min_x = min(p.X for p in points)
    max_x = max(p.X for p in points)
    min_y = min(p.Y for p in points)
    max_y = max(p.Y for p in points)
    return min_x, max_x, min_y, max_y

def rasterize_pointcloud(points, resolution, mode="max"):
    """Convert point cloud to raster grid."""
    min_x, max_x, min_y, max_y = compute_bounds(points)
    cols = int(math.ceil((max_x - min_x) / resolution))
    rows = int(math.ceil((max_y - min_y) / resolution))

    raster = [[None for _ in range(cols)] for _ in range(rows)]
    for p in points:
        c = int((p.X - min_x) / resolution)
        r = int((p.Y - min_y) / resolution)
        if 0 <= r < rows and 0 <= c < cols:
            if raster[r][c] is None:
                raster[r][c] = p.Z
            else:
                if mode == "max":
                    raster[r][c] = max(raster[r][c], p.Z)
                else:
                    raster[r][c] = min(raster[r][c], p.Z)
    return raster, min_x, min_y, rows, cols

def point_in_poly(x, y, poly):
    """Ray casting algorithm to check if point is inside a closed polyline."""
    pts = [poly[i] for i in range(poly.Count)]
    inside = False
    j = len(pts) - 1
    for i in range(len(pts)):
        xi, yi = pts[i].X, pts[i].Y
        xj, yj = pts[j].X, pts[j].Y
        if ((yi > y) != (yj > y)) and (x < (xj - xi) * (y - yi) / ((yj - yi) + 1e-9) + xi):
            inside = not inside
        j = i
    return inside

def extract_heights_from_raster(poly, raster, min_x, min_y, resolution, percentile=95):
    """Extract building height from DHM raster."""
    bb = poly.BoundingBox
    c0 = int((bb.Min.X - min_x) / resolution)
    r0 = int((bb.Min.Y - min_y) / resolution)
    c1 = int((bb.Max.X - min_x) / resolution)
    r1 = int((bb.Max.Y - min_y) / resolution)

    heights = []
    for r in range(max(0, r0), min(len(raster), r1 + 1)):
        for c in range(max(0, c0), min(len(raster[0]), c1 + 1)):
            if raster[r][c] is not None:
                x = min_x + c * resolution + resolution / 2
                y = min_y + r * resolution + resolution / 2
                if point_in_poly(x, y, poly):
                    heights.append(raster[r][c])

    if not heights:
        return None, None, []

    heights.sort()
    median = statistics.median(heights)
    q1 = heights[int(0.25 * len(heights))]
    q3 = heights[int(0.75 * len(heights))]
    iqr = q3 - q1
    filtered = [h for h in heights if (median - 2 * iqr) <= h <= (median + 2 * iqr)]
    if not filtered:
        filtered = heights

    filtered.sort()
    idx = int(len(filtered) * percentile / 100.0)
    idx = min(idx, len(filtered) - 1)
    height_value = filtered[idx]
    return height_value, median, filtered

# ================================
# MAIN EXECUTION
# ================================
try:
    print("🗺️ Rasterizing DSM and DTM...")
    dsm_raster, min_x, min_y, rows, cols = rasterize_pointcloud(DSM, resolution, mode="max")
    dtm_raster, _, _, _, _ = rasterize_pointcloud(DTM, resolution, mode="min")

    # Compute DHM = DSM - DTM
    dhm_raster = [[None for _ in range(cols)] for _ in range(rows)]
    for r in range(rows):
        for c in range(cols):
            if dsm_raster[r][c] is not None and dtm_raster[r][c] is not None:
                dhm_raster[r][c] = dsm_raster[r][c] - dtm_raster[r][c]

    print("🏢 Extracting building heights from DHM...")
    BuildingHeights = []
    for b in Buildings:
        h, _, _ = extract_heights_from_raster(b, dhm_raster, min_x, min_y, resolution, percentile)
        BuildingHeights.append(h if h is not None else 0.0)

    print(f"✅ Processed {len(Buildings)} buildings.")

except Exception as e:
    import traceback
    BuildingHeights = []
    print(f"❌ Error: {e}")
    print(traceback.format_exc())
# ---------- end py3_2 ----------
Z = UnitZ(Factor=1)
project = ProjectPoint(Point=area_3.Centroid, Direction=Z, Geometry=del)  # -> Point, Index
Z_2 = UnitZ(Factor=py3_2.BuildingHeights)
vec2pt = Vector2Pt(PointA=area_3.Centroid, PointB=project.Point, Unitize=False)  # -> Vector, Length
move = Move(Geometry=geo, Motion=vec2pt.Vector)  # -> Geometry, Transform
extr = Extrude(Base=move.Geometry, Direction=Z_2)
tstat = TreeStatistics(Tree=osm_bld_data.Attr)  # -> Paths, Length, Count
capex = CapHolesEx(Brep=extr)  # -> Brep, Caps, Solid
dispatch_3 = Dispatch(List=tstat.Paths, DispatchPattern=flatten(larger.LargerThan))  # -> ListA, ListB
dispatch_4 = Dispatch(List=capex.Brep, DispatchPattern=flatten(larger.LargerThan))  # -> ListA, ListB
resi = Geometry(dispatch_4.ListA)
non_resi = Geometry(dispatch_4.ListB)
branch = TreeBranch(Tree=osm_bld_data.Attr, Path=dispatch_3.ListA, MaintainPaths=True)
branch_2 = TreeBranch(Tree=osm_bld_data.Attr, Path=dispatch_3.ListB, MaintainPaths=True)
rep_2 = ReplaceText(Text=branch_2, Find=": ", Replace="-", RecursiveReplace=False)
rep_3 = ReplaceText(Text=branch, Find=": ", Replace="-", RecursiveReplace=False)
split_3 = TextSplit(Text=rep_2, Separators="-")
split_4 = TextSplit(Text=rep_3, Separators="-")
item_6 = ListItem(List=split_3, Index=0, Wrap=True)
item_7 = ListItem(List=split_3, Index=1, Wrap=True)
item_8 = ListItem(List=split_4, Index=0, Wrap=True)
item_9 = ListItem(List=split_4, Index=1, Wrap=True)
pshift_5 = ShiftPaths(Data=item_6, Offset=-1)
pshift_6 = ShiftPaths(Data=item_7, Offset=-1)
pshift_7 = ShiftPaths(Data=item_8, Offset=-1)
pshift_8 = ShiftPaths(Data=item_9, Offset=-1)
simplify = SimplifyTree(Tree=graft(non_resi), Front=False)
simplify_2 = SimplifyTree(Tree=graft(resi), Front=False)
renumber = RenumberPaths(Data=pshift_5)
renumber_2 = RenumberPaths(Data=pshift_6)
renumber_3 = RenumberPaths(Data=pshift_7)
renumber_4 = RenumberPaths(Data=pshift_8)
null = NullItem(Item=flatten(simplify))  # -> NullFlags, InvalidFlags, Description
null_2 = NullItem(Item=flatten(simplify_2))  # -> NullFlags, InvalidFlags, Description
tstat_2 = TreeStatistics(Tree=simplify)  # -> Paths, Length, Count
tstat_3 = TreeStatistics(Tree=simplify_2)  # -> Paths, Length, Count
dispatch_5 = Dispatch(List=tstat_2.Paths, DispatchPattern=null.NullFlags)  # -> ListA, ListB
dispatch_6 = Dispatch(List=tstat_3.Paths, DispatchPattern=null_2.NullFlags)  # -> ListA, ListB
branch_3 = TreeBranch(Tree=renumber, Path=dispatch_5.ListB, MaintainPaths=True)
branch_4 = TreeBranch(Tree=renumber_3, Path=dispatch_6.ListB, MaintainPaths=True)
branch_5 = TreeBranch(Tree=renumber_2, Path=dispatch_5.ListB, MaintainPaths=True)
branch_6 = TreeBranch(Tree=renumber_4, Path=dispatch_6.ListB, MaintainPaths=True)
branch_7 = TreeBranch(Tree=simplify, Path=dispatch_5.ListB, MaintainPaths=True)
branch_8 = TreeBranch(Tree=simplify_2, Path=dispatch_6.ListB, MaintainPaths=True)
renumber_5 = RenumberPaths(Data=branch_8)
renumber_6 = RenumberPaths(Data=branch_4)
renumber_7 = RenumberPaths(Data=branch_6)
brep = Brep(flatten(renumber_5))
volume = Volume(Geometry=brep)  # -> Volume, Centroid
division_2 = Division(A=volume.Volume, B=3.2)
incurve = PointInCurve(Point=volume.Centroid, Curve=graft(rint))  # -> Relationship, Point
equals = Equality(FirstNumber=incurve.Relationship, SecondNumber="2")  # -> Equality, Inequality
dispatch_7 = Dispatch(List=brep, DispatchPattern=equals.Equality)  # -> ListA, ListB
dispatch_8 = Dispatch(List=division_2, DispatchPattern=equals.Equality)  # -> ListA, ListB
num = Number(dispatch_8.ListA)
ma_2 = MassAddition(Input=num)  # -> Result, PartialResults
division_3 = Division(A=num, B=ma_2.Result)
ins_2 = InsertItems(List=renumber_6, Item="Est_Pop", Indices="0", Wrap=True)
multiplication_2 = Multiplication(A=round.Nearest, B=division_3)
round_2 = Round(Number=multiplication_2)  # -> Nearest, Floor, Ceiling
lng = ListLength(List=num)
equals_2 = Equality(FirstNumber=lng, SecondNumber="0")  # -> Equality, Inequality
estimated_population = Integer(round_2.Nearest)
residential = Brep(dispatch_7.ListA)
index = ItemIndex(List=brep, Item=residential)  # -> flatten(Index)
dispatch_9 = Dispatch(List=estimated_population, DispatchPattern=equals_2.Equality)  # -> ListA, ListB
object = ModelObject(Geometry=branch_7, Layer="UC::OSM::Buildings")  # -> Object, Geometry, Name, Layer, Visibility, Display, Drafting, Render
object_2 = ModelObject(Geometry=branch_7, Layer="UC::OSM::Buildings")  # -> Object, Geometry, Name, Layer, Visibility, Display, Drafting, Render
sort = SortList(Keys=index, ValuesA=flatten(dispatch_9.ListB))  # -> Keys, graft(ValuesA)
simplify_3 = SimplifyTree(Tree=sort.ValuesA, Front=False)
ins_3 = InsertItems(List=renumber_7, Item=simplify_3, Indices="0", Wrap=True)
u_text = UserText(Content=object.Object, Keys=branch_3, Values=branch_5, UserTextMode=1)  # -> Content, Keys, Values
u_text_2 = UserText(Content=object_2.Object, Keys=ins_2, Values=ins_3, UserTextMode=1)  # -> Content, Keys, Values
c_bake = ContextBake(Content=[u_text.Content, u_text_2.Content])
