# Grasshopper definition V2_TREE_DETECTION_COMPONENT.gh (Grasshopper 1.0.8)

vom_mesh = GetGeometry(
    AnnotationTypeFilter=3454,
    AtLeast=1,
    AtMost=1,
    DeleteInput=False,
    Filter=262144,
    Prompt="Select VOM meshs generated through the LIDAR component",
    TreeAccess=False)
dtm_mesh = GetGeometry(
    AnnotationTypeFilter=3454,
    AtLeast=1,
    AtMost=1,
    DeleteInput=False,
    Filter=262144,
    Prompt="Select DTM meshs generated through the LIDAR component",
    TreeAccess=False)
resolution = GetNumber(
    "0.5",
    AtLeast=1,
    AtMost=1,
    Maximum=1.797693135e+308,
    Minimum=-1.797693135e+308,
    Prompt="Grid cell size in meters",
    TreeAccess=False)
min_tree_height = GetNumber(
    "2",
    AtLeast=1,
    AtMost=1,
    Maximum=1.797693135e+308,
    Minimum=-1.797693135e+308,
    Prompt="Minimum height to be considered a tree (m)",
    TreeAccess=False)
local_max_radius = GetNumber(
    "1.5",
    AtLeast=1,
    AtMost=1,
    Maximum=1.797693135e+308,
    Minimum=-1.797693135e+308,
    Prompt="Radius to check for local maxima (m)",
    TreeAccess=False)
canopy_drop_ratio = GetNumber(
    "0.5",
    AtLeast=1,
    AtMost=1,
    Maximum=1.797693135e+308,
    Minimum=-1.797693135e+308,
    Prompt="Fraction of height drop to define canopy edge",
    TreeAccess=False)
vom = Mesh(vom_mesh)
dtm = Mesh(dtm_mesh)
demesh = DeconstructMesh(Mesh=vom)  # -> Vertices, Faces, Colours, Normals
point_cloud = PointCloudAttributes(Locations=demesh.Vertices)  # -> Cloud, Locations, Normals, Colours, Extra, Hidden
tree_detection = Python3Script(VOM=point_cloud.Cloud, RES=resolution, MTH=min_tree_height, LMR=local_max_radius, CDR=canopy_drop_ratio)  # -> out, TreePoints, TreeHeights, TreeRadii; inputs VOM: PointCloud, RES: Double, MTH: Double, LMR: Double, CDR: Double
# ---------- tree_detection: Python ----------
#! python 3
# r: shapely
import math
from Rhino.Geometry import Point3d

# ================================
# Parameters
# ================================
resolution = RES  # Grid cell size in meters
min_tree_height = MTH  # Minimum height to be considered a tree (m)
local_max_radius = LMR  # Radius to check for local maxima (m)
canopy_drop_ratio = CDR  # Fraction of height drop to define canopy edge

# ================================
# Helper Functions
# ================================
def compute_bounds(points):
    """Compute bounding box of the point cloud."""
    min_x = min(p.X for p in points)
    max_x = max(p.X for p in points)
    min_y = min(p.Y for p in points)
    max_y = max(p.Y for p in points)
    return min_x, max_x, min_y, max_y

def rasterize_pointcloud(points, resolution, mode="max"):
    """
    Rasterizes a point cloud into a grid.

    """
    min_x, max_x, min_y, max_y = compute_bounds(points)
    cols = int(math.ceil((max_x - min_x) / resolution))
    rows = int(math.ceil((max_y - min_y) / resolution))

    raster = [[None for _ in range(cols)] for _ in range(rows)]
    for p in points:
        c = int((p.X - min_x) / resolution)
        r = int((p.Y - min_y) / resolution)
        if 0 <= r < rows and 0 <= c < cols:
            if raster[r][c] is None:
                raster[r][c] = p.Z
            else:
                if mode == "max":
                    raster[r][c] = max(raster[r][c], p.Z)
                else:
                    raster[r][c] = min(raster[r][c], p.Z)

    return raster, min_x, min_y, rows, cols

def is_local_max(vom, r, c, radius_cells):
    """Check if the current cell is a local maximum within a radius."""
    center_val = vom[r][c]
    for dr in range(-radius_cells, radius_cells + 1):
        for dc in range(-radius_cells, radius_cells + 1):
            rr = r + dr
            cc = c + dc
            if 0 <= rr < len(vom) and 0 <= cc < len(vom[0]):
                if vom[rr][cc] is not None and vom[rr][cc] > center_val:
                    return False
    return True

def detect_trees(vom, min_x, min_y, resolution, min_height, local_max_radius):
    """Detect tree tops as local maxima in CHM."""
    trees = []
    radius_cells = int(local_max_radius / resolution)
    rows, cols = len(vom), len(vom[0])
    for r in range(rows):
        for c in range(cols):
            if vom[r][c] is not None and vom[r][c] >= min_height:
                if is_local_max(vom, r, c, radius_cells):
                    x = min_x + c * resolution + resolution / 2
                    y = min_y + r * resolution + resolution / 2
                    trees.append((x, y, vom[r][c], r, c))
    return trees

def estimate_tree_radius(vom, r, c, tree_height, resolution, drop_ratio):
    """Estimate canopy radius with sub-cell precision."""
    threshold = tree_height * drop_ratio
    max_search = 50  # max search radius in cells
    rows, cols = len(vom), len(vom[0])

    def get_val(rr, cc):
        if 0 <= rr < rows and 0 <= cc < cols:
            return vom[rr][cc]
        return None

    for search_radius in range(1, max_search + 1):
        # Check perimeter cells in this ring
        perimeter_cells = []
        for dr in range(-search_radius, search_radius + 1):
            for dc in [-search_radius, search_radius]:
                perimeter_cells.append((r + dr, c + dc))
        for dc in range(-search_radius + 1, search_radius):
            for dr in [-search_radius, search_radius]:
                perimeter_cells.append((r + dr, c + dc))

        for rr, cc in perimeter_cells:
            val = get_val(rr, cc)
            if val is not None and val < threshold:
                # Found a drop cell – refine radius
                dx = (cc - c) * resolution
                dy = (rr - r) * resolution
                dist = math.sqrt(dx * dx + dy * dy)
                return refine_radius_along_line(vom, r, c, rr, cc, threshold, resolution, dist)

    # If no drop found
    return max_search * resolution


def refine_radius_along_line(vom, r, c, rr, cc, threshold, resolution, dist):
    """Refine radius between two cells using linear interpolation."""
    steps = int(dist / (0.1 * resolution))  # 0.1x resolution step
    x_step = (cc - c) / steps
    y_step = (rr - r) / steps
    x, y = c, r
    for _ in range(steps):
        x += x_step
        y += y_step
        xi, yi = int(round(x)), int(round(y))
        if 0 <= yi < len(vom) and 0 <= xi < len(vom[0]):
            val = vom[yi][xi]
            if val is not None and val < threshold:
                return math.sqrt(((x - c) * resolution) ** 2 + ((y - r) * resolution) ** 2)
    return dist

# ================================
# MAIN EXECUTION
# ================================
try:
    # Convert PointClouds to Point3d lists
    vom_points = [VOM[i].Location for i in range(VOM.Count)]

    print("🌲 Rasterizing point clouds...")
    vom_raster, min_x, min_y, rows, cols = rasterize_pointcloud(vom_points, resolution, mode="max")

    print("🔍 Detecting trees...")
    raw_trees = detect_trees(vom_raster, min_x, min_y, resolution, min_tree_height, local_max_radius)

    TreePoints = []
    TreeHeights = []
    TreeRadii = []

    for x, y, h, r, c in raw_trees:
        radius = estimate_tree_radius(vom_raster, r, c, h, resolution, canopy_drop_ratio)
        TreePoints.append(Point3d(x, y, h))
        TreeHeights.append(h)
        TreeRadii.append(radius)

    print(f"✅ Detected {len(TreePoints)} trees")

except Exception as e:
    import traceback
    TreePoints = []
    TreeHeights = []
    TreeRadii = []
    print(f"❌ Error: {e}")
    print(traceback.format_exc())
# ---------- end tree_detection ----------
Z = UnitZ(Factor="1000")
move = Move(Geometry=tree_detection.TreePoints, Motion=Z)  # -> Geometry, Transform
bnd = Bounds(Numbers=tree_detection.TreeRadii)
project = ProjectPoint(Point=move.Geometry, Direction=Vector(0, 0, -1), Geometry=dtm)  # -> Point, Index
c_print = ContextPrint(Text=tree_detection.out)
line = LineSDL(Start=project.Point, Direction=Vector(0, 0, 1), Length=tree_detection.TreeHeights)
divide = DivideCurve(Curve=line, Count=3, Kinks=False)  # -> Points, Tangents, Parameters
remap = RemapNumbers(Value=tree_detection.TreeRadii, Source=bnd, Target="0.05 to 0.25")  # -> Mapped, Clipped
item = ListItem(List=divide.Points, Index="2", Wrap=True)  # -> flatten(Item)
item_2 = ListItem(List=divide.Points, Index="-1", Wrap=True)
item_3 = ListItem(List=divide.Points, Index="1", Wrap=True)
msphere = MeshSphere(Base=item, Radius=tree_detection.TreeRadii, UCount="5", VCount="5")
pipe = Pipe(Curve=line, Radius=remap.Mapped, Caps=1)
dist = Distance(PointA=item_2, PointB=item_3)  # -> flatten(Distance)
mesh = MeshBrep(
    Brep=pipe,
    Settings={GridMaxCount=0, GridMinCount=16, JaggedSeams=False, MaxEdgeLength=0, MinEdgeLength=0.0001, MinTolerance=0, Refine=True, RefineAngle=0, RelativeTolerance=0.65, SimplePlanes=True, Tolerance=0})
division = Division(A=dist, B=tree_detection.TreeRadii)
division_2 = Division(A=division, B=2)
scale_nu = ScaleNU(Geometry=msphere, Plane=item, ScaleX=1, ScaleY=1, ScaleZ=division_2)  # -> graft(Geometry), Transform
merge = Merge(Data1=scale_nu.Geometry, Data2=mesh)
mjoin = MeshJoin(Meshes=merge)
panel = Panel("""Tree_Height
Tree_Radii""")
object = ModelObject(Geometry=project.Point, Layer="UC::MODEL::TREE::2D")  # -> Object, Geometry, Name, Layer, Visibility, Display, Drafting, Render
object_2 = ModelObject(Geometry=mjoin, Layer="UC::MODEL::TREE::3D")  # -> Object, Geometry, Name, Layer, Visibility, Display, Drafting, Render
merge_2 = Merge(Data1=graft(tree_detection.TreeHeights), Data2=graft(tree_detection.TreeRadii))
u_text = UserText(Content=graft(object.Object), Keys=panel, Values=merge_2, UserTextMode=1)  # -> Content, Keys, Values
c_bake = ContextBake(Content=object_2.Object)
c_bake_2 = ContextBake(Content=u_text.Content)
